# Grasshopper definition EnergySim_regional.gh (Grasshopper 1.0.8)
# plug-ins: LadybugGrasshopper

# Weather File
panel = Panel("D:\data revision\Pipeline\0A_Singapore_TMY_2001-2020.epw")

geosupermarket = Geometry([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])
geohdb = Geometry([<extrusion referenced from the Rhino model> x23])
geolanded = Geometry([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])
geoprivateapt = Geometry([<extrusion referenced from the Rhino model> x3])
# Geometry
georetail = Geometry([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])
georestaurant = Geometry([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])
geohotel = Geometry(<extrusion referenced from the Rhino model>)
geooffice = Geometry([<extrusion referenced from the Rhino model> x11])
geohospital = Geometry([<extrusion referenced from the Rhino model> x27])
geosports = Geometry([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])
geoclinic = Geometry([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])
geonursing = Geometry([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])
geocivic = Geometry([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])

# ----
# Private Apt
falsestart = LBFalseStartToggle(True)
energysimprivateapt = EnergySimPrivateApt(geo=geoprivateapt, epw_file=panel, run=falsestart, weather_file=panel)  # -> idf, eui_2, eui_end_use, end_uses, gross_floor
panel_2 = Panel(energysimprivateapt.eui_end_use)
panel_3 = Panel(energysimprivateapt.eui_2)
panel_4 = Panel(energysimprivateapt.gross_floor)
panel_5 = Panel(energysimprivateapt.end_uses)

# ----
# HDB
falsestart_2 = LBFalseStartToggle(False)
# Energy Simulation Model Clusters
energysimhdb = EnergySimHDB(geo=geohdb, epw_file=panel, run=falsestart_2, weather_file=panel)  # -> idf, eui_2, eui_end_use, end_uses, gross_floor
panel_6 = Panel(energysimhdb.gross_floor)
panel_7 = Panel(energysimhdb.eui_2)
panel_8 = Panel(energysimhdb.eui_end_use)
panel_9 = Panel(energysimhdb.end_uses)

# ----
# Landed Property
falsestart_3 = LBFalseStartToggle(False)
energysimlanded = EnergySimLanded(geo=geolanded, epw_file=panel, run=falsestart_3, weather_file=panel)  # -> idf, eui_3, eui_end_use, end_uses, gross_floor
panel_10 = Panel(energysimlanded.eui_3)
panel_11 = Panel(energysimlanded.eui_end_use)
panel_12 = Panel(energysimlanded.gross_floor)
panel_13 = Panel(energysimlanded.end_uses)

# ----
# Hotel
falsestart_4 = LBFalseStartToggle(True)
energysimhotel = EnergySimHotel(geo=geohotel, epw_file=panel, run=falsestart_4, weather_file=panel)  # -> idf, eui_2, eui_end_use, end_uses, gross_floor
panel_14 = Panel(energysimhotel.eui_2)
panel_15 = Panel(energysimhotel.eui_end_use)
panel_16 = Panel(energysimhotel.gross_floor)
panel_17 = Panel(energysimhotel.end_uses)

# ----
# Retail
falsestart_5 = LBFalseStartToggle(False)
energysimretail = EnergySimRetail(geo=georetail, epw_file=panel, run=falsestart_5, weather_file=panel)  # -> idf, eui_2, eui_end_use, end_uses, gross_floor
panel_18 = Panel(energysimretail.eui_2)
panel_19 = Panel(energysimretail.gross_floor)
panel_20 = Panel(energysimretail.eui_end_use)
panel_21 = Panel(energysimretail.end_uses)

# ----
# Civic Community Culture Inst
falsestart_6 = LBFalseStartToggle(False)
energysimcivic = EnergySimCivic(geo=geocivic, epw_file=panel, run=falsestart_6, weather_file=panel)  # -> idf, eui_2, eui_end_use, end_uses, gross_floor
panel_22 = Panel(energysimcivic.eui_2)
panel_23 = Panel(energysimcivic.gross_floor)
panel_24 = Panel(energysimcivic.eui_end_use)
panel_25 = Panel(energysimcivic.end_uses)

# ----
# Office
falsestart_7 = LBFalseStartToggle(True)
energysimoffice = EnergySimOffice(geo=geooffice, epw_file=panel, run=falsestart_7, weather_file=panel)  # -> idf, eui_2, eui_end_use, end_uses, gross_floor
panel_26 = Panel(energysimoffice.eui_end_use)
panel_27 = Panel(energysimoffice.gross_floor)
panel_28 = Panel(energysimoffice.eui_2)
panel_29 = Panel(energysimoffice.end_uses)

# ----
# Nursing Home
falsestart_8 = LBFalseStartToggle(False)
clusternursing = ClusterNursing(geo=geonursing, epw_file=panel, run=falsestart_8, weather_file=panel)  # -> idf, eui_2, eui_end_use, end_uses, gross_floor
panel_30 = Panel(clusternursing.eui_2)
panel_31 = Panel(clusternursing.eui_end_use)
panel_32 = Panel(clusternursing.gross_floor)
panel_33 = Panel(clusternursing.end_uses)

# ----
# Clinic
falsestart_9 = LBFalseStartToggle(False)
energysimclinic = EnergySimClinic(geo=geoclinic, epw_file=panel, run=falsestart_9, weather_file=panel)  # -> idf, eui_2, eui_end_use, end_uses, gross_floor
panel_34 = Panel(energysimclinic.eui_2)
panel_35 = Panel(energysimclinic.eui_end_use)
panel_36 = Panel(energysimclinic.gross_floor)
panel_37 = Panel(energysimclinic.end_uses)

# ----
# Hospital
falsestart_10 = LBFalseStartToggle(False)
energysimhospital = EnergySimHospital(geo=geohospital, epw_file=panel, run=falsestart_10, weather_file=panel)  # -> idf, eui_2, eui_end_use, end_uses, gross_floor
panel_38 = Panel(energysimhospital.eui_end_use)
panel_39 = Panel(energysimhospital.gross_floor)
panel_40 = Panel(energysimhospital.eui_2)
panel_41 = Panel(energysimhospital.end_uses)

# ----
# Sports & Recreation
falsestart_11 = LBFalseStartToggle(False)
energysimsports = EnergySimSports(geo=geosports, epw_file=panel, run=falsestart_11, weather_file=panel)  # -> idf, eui_2, eui_end_use, end_uses, gross_floor
panel_42 = Panel(energysimsports.eui_end_use)
panel_43 = Panel(energysimsports.eui_2)
panel_44 = Panel(energysimsports.gross_floor)
panel_45 = Panel(energysimsports.end_uses)

# ----
# Restaurant
falsestart_12 = LBFalseStartToggle(False)
energysimrestaurant = EnergySimRestaurant(geo=georestaurant, epw_file=panel, run=falsestart_12, weather_file=panel)  # -> idf, eui_2, eui_end_use, end_uses, gross_floor
panel_46 = Panel(energysimrestaurant.eui_2)
panel_47 = Panel(energysimrestaurant.eui_end_use)
panel_48 = Panel(energysimrestaurant.gross_floor)
panel_49 = Panel(energysimrestaurant.end_uses)

# ----
# Supermarket
falsestart_13 = LBFalseStartToggle(False)
energysimsupermarket = EnergySimSupermarket(geo=geosupermarket, epw_file=panel, run=falsestart_13, weather_file=panel)  # -> idf, eui_2, eui_end_use, end_uses, gross_floor
panel_50 = Panel(energysimsupermarket.eui_end_use)
panel_51 = Panel(energysimsupermarket.eui_2)
panel_52 = Panel(energysimsupermarket.gross_floor)
panel_53 = Panel(energysimsupermarket.end_uses)

mergebreakdown = Merge(
    Data1=panel_8,
    Data2=panel_11,
    Data3=panel_2,
    Data4=panel_15,
    Data5=panel_20,
    Data6=panel_26,
    Data7=panel_38,
    Data8=panel_35,
    Data9=panel_31,
    Data10=panel_24,
    Data11=panel_42,
    Data12=panel_47,
    Data13=panel_50)
mergeeui = Merge(
    Data1=panel_7,
    Data2=panel_10,
    Data3=panel_3,
    Data4=panel_14,
    Data5=panel_18,
    Data6=panel_28,
    Data7=panel_40,
    Data8=panel_34,
    Data9=panel_30,
    Data10=panel_22,
    Data11=panel_43,
    Data12=panel_46,
    Data13=panel_51)
mergearea = Merge(
    Data1=panel_6,
    Data2=panel_12,
    Data3=panel_4,
    Data4=panel_16,
    Data5=panel_19,
    Data6=panel_27,
    Data7=panel_39,
    Data8=panel_32,
    Data9=panel_23,
    Data10=panel_44,
    Data11=panel_48,
    Data12=panel_52)
# Regional EUI Calculation
regionaleui = Python3Script(gross_floor_list=flatten(mergearea), total_eui_list=flatten(mergeeui), eui_end_use_list=flatten(mergebreakdown))  # -> out, region_eui, region_end_use, region_eui_end_use; inputs gross_floor_list: list, total_eui_list: list, eui_end_use_list: list
# ---------- regionaleui: Python ----------
# ---- Helper functions ----
def to_float(x):
    """Convert GH panel object or string to float, return None if invalid."""
    try:
        return float(x)
    except:
        try:
            return float(str(x))
        except:
            return None

def flatten_to_floats(lst):
    """Flatten list-like GH output to floats, skip None values."""
    if lst is None:
        return []
    if isinstance(lst, (int, float, str)):
        val = to_float(lst)
        return [val] if val is not None else []
    return [to_float(i) for i in lst if to_float(i) is not None]

# ---- Inputs ----
# _total_eui_list, _gross_floor_list, _eui_end_use_list
# num_enduses (optional)
num_enduses = 5

# ---- Convert inputs to lists of floats, skip None ----
total_eui_list_num = flatten_to_floats(_total_eui_list)
gross_floor_list_num = flatten_to_floats(_gross_floor_list)

# ---- Align lengths: only use matching entries ----
min_len = min(len(total_eui_list_num), len(gross_floor_list_num))
total_eui_list_num = total_eui_list_num[:min_len]
gross_floor_list_num = gross_floor_list_num[:min_len]

# ---- Process end-use list ----
eui_end_use_list_num = []

if _eui_end_use_list:
    if isinstance(_eui_end_use_list, (list, tuple)) and all(isinstance(x, (list, tuple)) for x in _eui_end_use_list):
        # Nested list per building
        for bld in _eui_end_use_list:
            tmp = flatten_to_floats(bld)
            if tmp:
                eui_end_use_list_num.append(tmp[:num_enduses])  # truncate if longer
    else:
        # Flat list or single value, split into chunks
        flat = flatten_to_floats(_eui_end_use_list)
        for i in range(0, len(flat), num_enduses):
            chunk = flat[i:i+num_enduses]
            if chunk:
                eui_end_use_list_num.append(chunk)
# Safety: ensure same number of buildings as gross_floor_list_num
while len(eui_end_use_list_num) < len(gross_floor_list_num):
    eui_end_use_list_num.append([0.0]*num_enduses)

# ---- Compute total area ----
total_area = sum(gross_floor_list_num)

# ---- Weighted total EUI and end-use EUI ----
region_eui = 0.0
region_eui_end_use = [0.0]*num_enduses

if total_area > 0:
    region_eui = sum(e*a for e,a in zip(total_eui_list_num, gross_floor_list_num)) / total_area
    for bld_eui_end_use, bld_area in zip(eui_end_use_list_num, gross_floor_list_num):
        for i in range(num_enduses):
            region_eui_end_use[i] += bld_eui_end_use[i] * bld_area
    region_eui_end_use = [v / total_area for v in region_eui_end_use]

# ---- Outputs ----
# region_eui : float
# region_eui_end_use : list of floats
region_end_use = ['Cooling','Interior Lighting','Electric Equipment','Fans','Water Systems']
# ---------- end regionaleui ----------
panel_54 = Panel(regionaleui.region_eui)
panel_55 = Panel(regionaleui.region_eui_end_use)
panel_56 = Panel(regionaleui.region_end_use)

# ==== cluster EnergySimHDB
panel = Panel("""0.92
0.82
0.74
0.68
0.64
0.63
0.66
0.64
0.58
0.53
0.00
0.00
0.00
0.00
0.00
0.00
0.00
0.00
0.00
0.70
0.80
0.95
1.00
0.98""")
panel_2 = Panel("""0.00
0.00
0.00
0.00
0.00
0.00
0.33
0.32
0.29
0.00
0.00
0.00
0.00
0.00
0.00
0.00
0.00
0.00
0.32
0.35
0.40
0.48
0.00
0.00""")
panel_3 = Panel("""0.15
0.15
0.15
0.15
0.15
0.15
0.33
0.32
0.29
0.15
0.15
0.15
0.15
0.15
0.15
0.15
0.15
0.30
0.32
0.35
0.40
0.48
0.15
0.15""")
# Schedule
panel_4 = Panel("""120
120
120
120
120
120
120
120
120
120
120
120
120
120
120
120
120
120
120
120
120
120
120
120""")
panel_5 = Panel("""20
20
20
20
20
20
20
20
20
20
20
20
20
20
20
20
20
20
20
20
20
20
20
20""")
panel_6 = Panel("""26
26
26
26
26
26
26
26
26
26
26
26
26
26
26
26
26
26
26
26
26
26
26
26""")
weeklyschedule = HBWeeklySchedule(
    sun=panel,
    mon=panel,
    tue=panel,
    wed=panel,
    thu=panel,
    fri=panel,
    sat=panel,
    name="Building Occupancy",
    type_limit="Fractional")  # -> report, schedule, idf_year, idf_week, idf_days; plug-in component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
constantschedule = HBConstantSchedule(values=panel_6, name="Cooling Setpoint", type_limit="Temperature")  # -> report, schedule, idf_text; plug-in component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
# Building Progam
constantschedule_2 = HBConstantSchedule(values=panel_4, name="Activity Level", type_limit="Activity Level")  # -> report, schedule, idf_text; plug-in component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
constantschedule_3 = HBConstantSchedule(values=panel_3, name="Equipment", type_limit="Fractional")  # -> report, schedule, idf_text; plug-in component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
constantschedule_4 = HBConstantSchedule(values=panel_5, name="Heating Setpoint", type_limit="Temperature")  # -> report, schedule, idf_text; plug-in component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
constantschedule_5 = HBConstantSchedule(values=panel_2, name="Lighting and Hotwater", type_limit="Fractional")  # -> report, schedule, idf_text; plug-in component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
# Construction
number_slider = Slider(0.125, range=0..1)
opaquemat = HBOpaqueMaterial(
    name="walls",
    thickness=number_slider,
    conductivity=Slider(0.303, range=0..1),
    density=Slider(1280, range=0..2000),
    spec_heat=Slider(840, range=0..2000))  # -> mat; plug-in component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
opaquemat_2 = HBOpaqueMaterial(
    name="exterior_floors",
    thickness=Slider(0.25, range=0..1),
    conductivity=Slider(1.442, range=0..2),
    density=Slider(2240, range=0..3000),
    spec_heat=Slider(840, range=0..2000))  # -> mat; plug-in component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
opaquemat_3 = HBOpaqueMaterial(
    name="roofs",
    thickness=Slider(0.2, range=0..1),
    conductivity=Slider(0.303, range=0..1),
    density=Slider(1280, range=0..2000),
    spec_heat=Slider(840, range=0..2000))  # -> mat; plug-in component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
opaqueconstr = HBOpaqueConstruction(name="exterior_wall", materials=opaquemat)  # -> constr; plug-in component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
opaqueconstr_2 = HBOpaqueConstruction(name="exterior_roof", materials=opaquemat_3)  # -> constr; plug-in component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
opaqueconstr_3 = HBOpaqueConstruction(name="exposed_floors", materials=opaquemat_2)  # -> constr; plug-in component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
panel_7 = Panel("Tinted Single Glazing Glass")
setpoint = HBSetpoint(
    name="HDB Setpoint",
    heating_sch=constantschedule_4.schedule,
    cooling_sch=constantschedule.schedule,
    humid_setpt=Slider(40, range=0..100),
    dehumid_setpt=Slider(70, range=0..100))  # -> setpoint; plug-in component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
servicehotwater = HBServiceHotWater(name="HDB Hot Water", flow_per_area=Slider(0.177425, range=0..10), schedule=constantschedule_5.schedule)  # -> hot_water; plug-in component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
lighting = HBLighting(
    name="HDB Lighting",
    watts_per_area=Slider(10, range=0..15),
    schedule=constantschedule_5.schedule,
    radiant_fract=Slider(0.2, range=0..6),
    visible_fract=Slider(0.7, range=0..6))  # -> lighting; plug-in component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
people = HBPeople(
    name="HDB People",
    ppl_per_area=Slider(0.0302, range=0..1),
    occupancy_sch=weeklyschedule.schedule,
    activity_sch=constantschedule_2.schedule,
    latent_fraction=Slider(0.3, range=0..1))  # -> people; plug-in component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
ventilation = HBVentilation(name="HDB Ventilation", ach=Slider(0.35, range=0..10), schedule=weeklyschedule.schedule)  # -> vent; plug-in component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
equipment = HBEquipment(
    name="HDB Equipment",
    watts_per_area=Slider(6, range=0..1000),
    schedule=constantschedule_3.schedule,
    radiant_fract=Slider(0.5, range=0..6),
    gas=Toggle(False))  # -> equip; plug-in component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
exteriorsubset = HBExteriorConstructionSubset(exterior_wall=opaqueconstr, exterior_roof=opaqueconstr_2, exposed_floor=opaqueconstr_3)  # -> exterior_set; plug-in component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
windowmat = HBWindowMaterial(name=panel_7, u_factor=Slider(4.88, range=0..6), shgc=Slider(0.23, range=0..1))  # -> mat; plug-in component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
windowconstr = HBWindowConstruction(name=panel_7, materials=windowmat)  # -> constr; plug-in component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
subfacesubset = HBSubfaceSubset(window=windowconstr)  # -> subface_set; plug-in component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
programtype = HBProgramType(
    name="HDB",
    people=people,
    lighting=lighting,
    electric_equip=equipment,
    hot_water=servicehotwater,
    ventilation=ventilation,
    setpoint=setpoint)  # -> program; plug-in component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
constructionset = HBConstructionSet(name="HDB", exterior_subset=exteriorsubset, subface_subset=subfacesubset)  # -> constr_set; plug-in component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
# Geometry
geo = ClusterInput()
roomsolid = HBRoomFromSolid(geo=flatten(geo), name="HDB Shoebox", constr_set=constructionset, program=programtype, conditioned=True)  # -> report, rooms; plug-in component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
thermalzone = IB_ThermalZone(_HBRooms=roomsolid.rooms, IsAirTerminalPriorToZoneEquipments=True, allowMultiAirloops=False, dupNum=False)
objparams = IB_ObjParams(
    Coefficient1OfthePartLoadPerformanceCurve="0",
    Coefficient2OfthePartLoadPerformanceCurve="0.0216",
    Coefficient3OfthePartLoadPerformanceCurve="-0.0325",
    Coefficient4OfthePartLoadPerformanceCurve="1.0095",
    DataFieldSetType="Ironbug.HVAC.IB_PumpVariableSpeed_FieldSet")
objparams_2 = IB_ObjParams(DataFieldSetType="Ironbug.HVAC.IB_FanVariableVolume_FieldSet")
objparams_3 = IB_ObjParams(
    CentralHeatingMaximumSystemAirFlowRatio="1",
    TypeofLoadtoSizeOn="VentilationRequirement",
    DataFieldSetType="Ironbug.HVAC.IB_SizingSystem_FieldSet")
objparams_4 = IB_ObjParams(RatedCOP=Slider(3.5, range=0..10), DataFieldSetType="Ironbug.HVAC.IB_CoilCoolingDXSingleSpeed_FieldSet")
districtcooling = IB_DistrictCooling(dupNum=False)
oasystem = Ironbug_OutdoorAirSystem()
coilclndx1 = Ironbug_CoilCoolingDXSingleSpeed(Parameters_=objparams_4, dupNum=False)
coilhtngas = Ironbug_CoilHeatingGas(dupNum=False)
fanvariable = Ironbug_FanVariableVolume(Parameters_=objparams_2, dupNum=False)
pipeadiabatic = Ironbug_PipeAdiabatic(dupNum=False)
spm_scheduled = Ironbug_SetpointManagerScheduled(Temperature="21.11", dupNum=False)
airloopbranches = AirLoopBranches(Branch1=thermalzone)
# Chilled water loop
pumpvariable = Ironbug_PumpVariableSpeed(Parameters=objparams, dupNum=False)
plantbranches = PlantBranches(B1=districtcooling, B2=pipeadiabatic, mapBranchToLoop=False)
spm_scheduled_2 = Ironbug_SetpointManagerScheduled(Temperature="6.7", dupNum=False)
plantbranches_2 = PlantBranches(mapBranchToLoop=False)
objparams_5 = IB_ObjParams(Name="DOAS", DataFieldSetType="Ironbug.HVAC.IB_AirLoopHVAC_FieldSet")
sizingsystem = Ironbug_SizingSystem(Parameters_=objparams_3, dupNum=False)
# DOAS
merge = Merge(Data1=oasystem, Data2=coilclndx1, Data3=coilhtngas, Data4=fanvariable, Data5=spm_scheduled)
cwloop = Ironbug_ChilledWaterPlantLoop(Supply=[pumpvariable, plantbranches, spm_scheduled_2], Demand=plantbranches_2, dupNum=False)
airloop = Ironbug_AirLoopHVAC(Supply=merge, Demand=airloopbranches, SizingSystem=sizingsystem, Parameters_=objparams_5, dupNum=False)
hvacsystem = IB_HVACSystem(AirLoops=flatten(airloop), PlantLoops=flatten(cwloop))
# District Cooling System
detailedhvac = HBDetailedHVAC(hb_objs=flatten(roomsolid.rooms), hvac_system=hvacsystem)  # -> report, hb_objs; plug-in component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
# Weather File (2000 - 2020)
toggle = BooleanToggle(True)
weather_file = ClusterInput()
toggle_2 = BooleanToggle(True)
solveadj = HBSolveAdjacency(rooms=flatten(detailedhvac.hb_objs), air_boundary=toggle_2, overwrite=toggle_2, run=toggle_2)  # -> report, adj_rooms; plug-in component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
epwtoddy = LBEPWToDDY(weather_file=weather_file, write=toggle)  # -> ddy_file; plug-in component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
simoutput = HBSimulationOutput(zone_energy_use=toggle, gains_and_losses=toggle, surface_energy_flow=toggle)  # -> report, sim_output; plug-in component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
# WWR
number_slider_2 = Slider(0.4, range=0..1)
sizingpar = HBSizingParameter(ddy_file=epwtoddy, filter_ddays=toggle)  # -> sizing; plug-in component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
aperturesbyratio = HBAperturesByRatio(hb_objs=flatten(solveadj.adj_rooms), ratio=number_slider_2, subdivide=Toggle(False))  # -> report, hb_objs; plug-in component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
simpar = HBSimulationParameter(output=simoutput.sim_output, timestep=6, sizing=sizingpar)  # -> sim_par; plug-in component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
model = HBModel(rooms=flatten(aperturesbyratio.hb_objs), name="HDB Archetype")  # -> report, model; plug-in component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
# Run Simulation
epw_file = ClusterInput()
run = ClusterInput()
modeltoosm = HBModelToOSM(model=model.model, epw_file=epw_file, write=Toggle(True), run=run)  # -> report, jsons, osw, osm, idf, sql, zsz, rdd, html; plug-in component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
idf = ClusterOutput(modeltoosm.idf)
eui = HBEndUseIntensity(sql=modeltoosm.sql, ip=Toggle(True))  # -> eui, eui_end_use, end_uses, gross_floor; plug-in component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
eui_2 = ClusterOutput(eui.eui)
eui_end_use = ClusterOutput(eui.eui_end_use)
end_uses = ClusterOutput(eui.end_uses)
gross_floor = ClusterOutput(eui.gross_floor)

# ==== cluster EnergySimPrivateApt

# ----
# Schedule
panel = Panel("""0.92
0.82
0.74
0.68
0.64
0.63
0.66
0.64
0.58
0.53
0.00
0.00
0.00
0.00
0.00
0.00
0.00
0.00
0.00
0.70
0.80
0.95
1.00
0.98""")
panel_2 = Panel("""0.15
0.15
0.15
0.15
0.15
0.15
0.33
0.32
0.29
0.15
0.15
0.15
0.15
0.15
0.15
0.15
0.15
0.30
0.32
0.35
0.40
0.48
0.15
0.15""")
panel_3 = Panel("""120
120
120
120
120
120
120
120
120
120
120
120
120
120
120
120
120
120
120
120
120
120
120
120""")
panel_4 = Panel("""0.00
0.00
0.00
0.00
0.00
0.00
0.33
0.32
0.29
0.00
0.00
0.00
0.00
0.00
0.00
0.00
0.00
0.00
0.32
0.35
0.40
0.48
0.00
0.00""")
panel_5 = Panel("""20
20
20
20
20
20
20
20
20
20
20
20
20
20
20
20
20
20
20
20
20
20
20
20""")
panel_6 = Panel("""26
26
26
26
26
26
26
26
26
26
26
26
26
26
26
26
26
26
26
26
26
26
26
26""")
weeklyschedule = HBWeeklySchedule(
    sun=panel,
    mon=panel,
    tue=panel,
    wed=panel,
    thu=panel,
    fri=panel,
    sat=panel,
    name="Building Occupancy",
    type_limit="Fractional")  # -> report, schedule, idf_year, idf_week, idf_days; plug-in component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
constantschedule = HBConstantSchedule(values=panel_6, name="Cooling Setpoint", type_limit="Temperature")  # -> report, schedule, idf_text; plug-in component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
constantschedule_2 = HBConstantSchedule(values=panel_3, name="Activity Level", type_limit="Activity Level")  # -> report, schedule, idf_text; plug-in component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
constantschedule_3 = HBConstantSchedule(values=panel_2, name="Equipment", type_limit="Fractional")  # -> report, schedule, idf_text; plug-in component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
constantschedule_4 = HBConstantSchedule(values=panel_5, name="Heating Setpoint", type_limit="Temperature")  # -> report, schedule, idf_text; plug-in component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
constantschedule_5 = HBConstantSchedule(values=panel_4, name="Lighting and Hotwater", type_limit="Fractional")  # -> report, schedule, idf_text; plug-in component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

# ----
# Construction
number_slider = Slider(1.442, range=0..2)
opaquemat = HBOpaqueMaterial(
    name="walls",
    thickness=Slider(0.125, range=0..1),
    conductivity=Slider(0.303, range=0..1),
    density=Slider(1280, range=0..2000),
    spec_heat=Slider(840, range=0..2000))  # -> mat; plug-in component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
opaquemat_2 = HBOpaqueMaterial(
    name="exterior_floors",
    thickness=Slider(0.25, range=0..1),
    conductivity=number_slider,
    density=Slider(2240, range=0..3000),
    spec_heat=Slider(840, range=0..2000))  # -> mat; plug-in component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
opaquemat_3 = HBOpaqueMaterial(
    name="roofs",
    thickness=Slider(0.2, range=0..1),
    conductivity=Slider(0.303, range=0..1),
    density=Slider(1280, range=0..2000),
    spec_heat=Slider(840, range=0..2000))  # -> mat; plug-in component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
panel_7 = Panel("Tinted Single Glazing Glass")
opaqueconstr = HBOpaqueConstruction(name="exterior_wall", materials=opaquemat)  # -> constr; plug-in component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
opaqueconstr_2 = HBOpaqueConstruction(name="exterior_roof", materials=opaquemat_3)  # -> constr; plug-in component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
opaqueconstr_3 = HBOpaqueConstruction(name="exposed_floors", materials=opaquemat_2)  # -> constr; plug-in component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
windowmat = HBWindowMaterial(name=panel_7, u_factor=Slider(4.88, range=0..6), shgc=Slider(0.23, range=0..1))  # -> mat; plug-in component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
exteriorsubset = HBExteriorConstructionSubset(exterior_wall=opaqueconstr, exterior_roof=opaqueconstr_2, exposed_floor=opaqueconstr_3)  # -> exterior_set; plug-in component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
windowconstr = HBWindowConstruction(name=panel_7, materials=windowmat)  # -> constr; plug-in component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
subfacesubset = HBSubfaceSubset(window=windowconstr)  # -> subface_set; plug-in component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
constructionset = HBConstructionSet(name="MFH", exterior_subset=exteriorsubset, subface_subset=subfacesubset)  # -> constr_set; plug-in component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

# ----
# Building Progam
number_slider_2 = Slider(10, range=0..15)
setpoint = HBSetpoint(
    name="MFH Setpoint",
    heating_sch=constantschedule_4.schedule,
    cooling_sch=constantschedule.schedule,
    humid_setpt=Slider(40, range=0..100),
    dehumid_setpt=Slider(70, range=0..100))  # -> setpoint; plug-in component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
servicehotwater = HBServiceHotWater(name="MFH Hot Water", flow_per_area=Slider(0.163325, range=0..10), schedule=constantschedule_5.schedule)  # -> hot_water; plug-in component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
lighting = HBLighting(
    name="MFH Lighting",
    watts_per_area=number_slider_2,
    schedule=constantschedule_5.schedule,
    radiant_fract=Slider(0.2, range=0..6),
    visible_fract=Slider(0.7, range=0..6))  # -> lighting; plug-in component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
people = HBPeople(
    name="MFH People",
    ppl_per_area=Slider(0.0278, range=0..1),
    occupancy_sch=weeklyschedule.schedule,
    activity_sch=constantschedule_2.schedule,
    latent_fraction=Slider(0.3, range=0..1))  # -> people; plug-in component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
ventilation = HBVentilation(name="MFH Ventilation", ach=Slider(0.35, range=0..10), schedule=weeklyschedule.schedule)  # -> vent; plug-in component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
equipment = HBEquipment(
    name="MFH Equipment",
    watts_per_area=Slider(6, range=0..1000),
    schedule=constantschedule_3.schedule,
    radiant_fract=Slider(0.5, range=0..6),
    gas=Toggle(False))  # -> equip; plug-in component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
programtype = HBProgramType(
    name="MFH",
    people=people,
    lighting=lighting,
    electric_equip=equipment,
    hot_water=servicehotwater,
    ventilation=ventilation,
    setpoint=setpoint)  # -> program; plug-in component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

geo = ClusterInput()

# ----
# Geometry
panel_8 = Panel("MFH Shoebox")
roomsolid = HBRoomFromSolid(geo=flatten(geo), name=panel_8, constr_set=constructionset, program=programtype, conditioned=True)  # -> report, rooms; plug-in component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

# ----
# Chilled water loop
panel_9 = Panel("0")
objparams = IB_ObjParams(
    Coefficient1OfthePartLoadPerformanceCurve=panel_9,
    Coefficient2OfthePartLoadPerformanceCurve="0.0216",
    Coefficient3OfthePartLoadPerformanceCurve="-0.0325",
    Coefficient4OfthePartLoadPerformanceCurve="1.0095",
    DataFieldSetType="Ironbug.HVAC.IB_PumpVariableSpeed_FieldSet")
districtcooling = IB_DistrictCooling(dupNum=False)
pipeadiabatic = Ironbug_PipeAdiabatic(dupNum=False)
pumpvariable = Ironbug_PumpVariableSpeed(Parameters=objparams, dupNum=False)
plantbranches = PlantBranches(B1=districtcooling, B2=pipeadiabatic, mapBranchToLoop=False)
spm_scheduled = Ironbug_SetpointManagerScheduled(Temperature="6.7", dupNum=False)
plantbranches_2 = PlantBranches(mapBranchToLoop=False)
cwloop = Ironbug_ChilledWaterPlantLoop(Supply=[pumpvariable, plantbranches, spm_scheduled], Demand=plantbranches_2, dupNum=False)

objparams_2 = IB_ObjParams(DataFieldSetType="Ironbug.HVAC.IB_FanVariableVolume_FieldSet")

# ----
# DOAS
number_slider_3 = Slider(3.5, range=0..10)
thermalzone = IB_ThermalZone(_HBRooms=roomsolid.rooms, IsAirTerminalPriorToZoneEquipments=True, allowMultiAirloops=False, dupNum=False)
objparams_3 = IB_ObjParams(
    CentralHeatingMaximumSystemAirFlowRatio="1",
    TypeofLoadtoSizeOn="VentilationRequirement",
    DataFieldSetType="Ironbug.HVAC.IB_SizingSystem_FieldSet")
objparams_4 = IB_ObjParams(RatedCOP=number_slider_3, DataFieldSetType="Ironbug.HVAC.IB_CoilCoolingDXSingleSpeed_FieldSet")
oasystem = Ironbug_OutdoorAirSystem()
coilclndx1 = Ironbug_CoilCoolingDXSingleSpeed(Parameters_=objparams_4, dupNum=False)
coilhtngas = Ironbug_CoilHeatingGas(dupNum=False)
fanvariable = Ironbug_FanVariableVolume(Parameters_=objparams_2, dupNum=False)
spm_scheduled_2 = Ironbug_SetpointManagerScheduled(Temperature="21.11", dupNum=False)
airloopbranches = AirLoopBranches(Branch1=thermalzone)
objparams_5 = IB_ObjParams(Name="DOAS", DataFieldSetType="Ironbug.HVAC.IB_AirLoopHVAC_FieldSet")
sizingsystem = Ironbug_SizingSystem(Parameters_=objparams_3, dupNum=False)
merge = Merge(Data1=oasystem, Data2=coilclndx1, Data3=coilhtngas, Data4=fanvariable, Data5=spm_scheduled_2)
airloop = Ironbug_AirLoopHVAC(Supply=merge, Demand=airloopbranches, SizingSystem=sizingsystem, Parameters_=objparams_5, dupNum=False)

hvacsystem = IB_HVACSystem(AirLoops=flatten(airloop), PlantLoops=flatten(cwloop))
# District Cooling System
detailedhvac = HBDetailedHVAC(hb_objs=flatten(roomsolid.rooms), hvac_system=hvacsystem)  # -> report, hb_objs; plug-in component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

toggle = BooleanToggle(True)
solveadj = HBSolveAdjacency(rooms=flatten(detailedhvac.hb_objs), air_boundary=toggle, overwrite=toggle, run=toggle)  # -> report, adj_rooms; plug-in component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

# ----
# WWR
number_slider_4 = Slider(0.4, range=0..1)
aperturesbyratio = HBAperturesByRatio(hb_objs=flatten(solveadj.adj_rooms), ratio=number_slider_4, subdivide=Toggle(False))  # -> report, hb_objs; plug-in component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

weather_file = ClusterInput()

# ----
# Weather File (2000 - 2020)
toggle_2 = BooleanToggle(True)
simoutput = HBSimulationOutput(zone_energy_use=toggle_2, gains_and_losses=toggle_2, surface_energy_flow=toggle_2)  # -> report, sim_output; plug-in component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
epwtoddy = LBEPWToDDY(weather_file=weather_file, monthly_cool=toggle_2, write=toggle_2)  # -> ddy_file; plug-in component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
sizingpar = HBSizingParameter(ddy_file=epwtoddy, filter_ddays=toggle_2)  # -> sizing; plug-in component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
simpar = HBSimulationParameter(output=simoutput.sim_output, timestep=6, sizing=sizingpar)  # -> sim_par; plug-in component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

model = HBModel(rooms=flatten(aperturesbyratio.hb_objs), name="MFH Archetype")  # -> report, model; plug-in component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
epw_file = ClusterInput()
run = ClusterInput()

# ----
# Run Simulation
toggle_3 = BooleanToggle(True)

modeltoosm = HBModelToOSM(model=model.model, epw_file=epw_file, sim_par=simpar, write=toggle_3, run=run)  # -> report, jsons, osw, osm, idf, sql, zsz, rdd, html; plug-in component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
idf = ClusterOutput(modeltoosm.idf)

eui = HBEndUseIntensity(sql=modeltoosm.sql, ip=Toggle(True))  # -> eui, eui_end_use, end_uses, gross_floor; plug-in component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

eui_2 = ClusterOutput(eui.eui)
eui_end_use = ClusterOutput(eui.eui_end_use)
end_uses = ClusterOutput(eui.end_uses)
gross_floor = ClusterOutput(eui.gross_floor)

# ==== cluster EnergySimHotel

# ----
# Schedule
panel = Panel("""0.92
0.82
0.74
0.68
0.64
0.63
0.66
0.64
0.58
0.53
0.10
0.10
0.10
0.10
0.10
0.10
0.10
0.10
0.10
0.70
0.80
0.95
1.00
0.98""")
panel_2 = Panel("""120
120
120
120
120
120
120
120
120
120
120
120
120
120
120
120
120
120
120
120
120
120
120
120""")
panel_3 = Panel("""0.00
0.00
0.00
0.00
0.00
0.00
0.66
0.64
0.58
0.00
0.00
0.00
0.00
0.00
0.00
0.00
0.00
0.00
0.63
0.70
0.80
0.95
0.00
0.00""")
panel_4 = Panel("""0.30
0.30
0.30
0.30
0.30
0.30
0.66
0.64
0.58
0.30
0.30
0.30
0.30
0.30
0.30
0.30
0.30
0.59
0.63
0.70
0.80
0.96
0.30
0.30""")
panel_5 = Panel("""20
20
20
20
20
20
20
20
20
20
20
20
20
20
20
20
20
20
20
20
20
20
20
20""")
panel_6 = Panel("""26
26
26
26
26
26
26
26
26
26
26
26
26
26
26
26
26
26
26
26
26
26
26
26""")
weeklyschedule = HBWeeklySchedule(
    sun=panel,
    mon=panel,
    tue=panel,
    wed=panel,
    thu=panel,
    fri=panel,
    sat=panel,
    name="Building Occupancy",
    type_limit="Fractional")  # -> report, schedule, idf_year, idf_week, idf_days; plug-in component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
constantschedule = HBConstantSchedule(values=panel_6, name="Cooling Setpoint", type_limit="Temperature")  # -> report, schedule, idf_text; plug-in component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
constantschedule_2 = HBConstantSchedule(values=panel_2, name="Activity Level", type_limit="Activity Level")  # -> report, schedule, idf_text; plug-in component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
constantschedule_3 = HBConstantSchedule(values=panel_4, name="Equipment", type_limit="Fractional")  # -> report, schedule, idf_text; plug-in component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
constantschedule_4 = HBConstantSchedule(values=panel_5, name="Heating Setpoint", type_limit="Temperature")  # -> report, schedule, idf_text; plug-in component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
constantschedule_5 = HBConstantSchedule(values=panel_3, name="Lighting and Hotwater", type_limit="Fractional")  # -> report, schedule, idf_text; plug-in component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

# ----
# Construction
number_slider = Slider(1.442, range=0..2)
opaquemat = HBOpaqueMaterial(
    name="walls",
    thickness=Slider(0.125, range=0..1),
    conductivity=Slider(0.303, range=0..1),
    density=Slider(1280, range=0..2000),
    spec_heat=Slider(840, range=0..2000))  # -> mat; plug-in component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
opaquemat_2 = HBOpaqueMaterial(
    name="exterior_floors",
    thickness=Slider(0.25, range=0..1),
    conductivity=number_slider,
    density=Slider(2240, range=0..3000),
    spec_heat=Slider(840, range=0..2000))  # -> mat; plug-in component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
opaquemat_3 = HBOpaqueMaterial(
    name="roofs",
    thickness=Slider(0.2, range=0..1),
    conductivity=Slider(0.303, range=0..1),
    density=Slider(1280, range=0..2000),
    spec_heat=Slider(840, range=0..2000))  # -> mat; plug-in component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
opaqueconstr = HBOpaqueConstruction(name="exterior_wall", materials=opaquemat)  # -> constr; plug-in component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
opaqueconstr_2 = HBOpaqueConstruction(name="exterior_roof", materials=opaquemat_3)  # -> constr; plug-in component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
opaqueconstr_3 = HBOpaqueConstruction(name="exposed_floors", materials=opaquemat_2)  # -> constr; plug-in component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
panel_7 = Panel("Double Glazing with Low Emission Coating")
exteriorsubset = HBExteriorConstructionSubset(exterior_wall=opaqueconstr, exterior_roof=opaqueconstr_2, exposed_floor=opaqueconstr_3)  # -> exterior_set; plug-in component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
windowmat = HBWindowMaterial(name=panel_7, u_factor=Slider(1.6, range=0..6), shgc=Slider(0.12, range=0..1))  # -> mat; plug-in component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
windowconstr = HBWindowConstruction(name=panel_7, materials=windowmat)  # -> constr; plug-in component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
subfacesubset = HBSubfaceSubset(window=windowconstr)  # -> subface_set; plug-in component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
constructionset = HBConstructionSet(name="Hotel", exterior_subset=exteriorsubset, subface_subset=subfacesubset)  # -> constr_set; plug-in component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

# ----
# Building Progam
number_slider_2 = Slider(12, range=0..15)
setpoint = HBSetpoint(
    name="Hotel Setpoint",
    heating_sch=constantschedule_4.schedule,
    cooling_sch=constantschedule.schedule,
    humid_setpt=Slider(40, range=0..100),
    dehumid_setpt=Slider(70, range=0..100))  # -> setpoint; plug-in component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
servicehotwater = HBServiceHotWater(
    name="Hotel Hot Water",
    flow_per_area=Slider(0.167903, range=0..10),
    schedule=[weeklyschedule.schedule, constantschedule_5.schedule])  # -> hot_water; plug-in component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
lighting = HBLighting(
    name="Hotel Lighting",
    watts_per_area=number_slider_2,
    schedule=constantschedule_5.schedule,
    radiant_fract=Slider(0.2, range=0..6),
    visible_fract=Slider(0.7, range=0..6))  # -> lighting; plug-in component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
people = HBPeople(
    name="Hotel People",
    ppl_per_area=Slider(0.023313, range=0..1),
    occupancy_sch=weeklyschedule.schedule,
    activity_sch=constantschedule_2.schedule,
    latent_fraction=Slider(0.3, range=0..1))  # -> people; plug-in component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
ventilation = HBVentilation(name="Hotel Ventilation", ach=Slider(5, range=0..10), schedule=weeklyschedule.schedule)  # -> vent; plug-in component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
equipment = HBEquipment(
    name="Hotel Equipment",
    watts_per_area=Slider(10, range=0..1000),
    schedule=constantschedule_3.schedule,
    radiant_fract=Slider(0.5, range=0..6),
    gas=Toggle(False))  # -> equip; plug-in component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
programtype = HBProgramType(
    name="Hotel",
    people=people,
    lighting=lighting,
    electric_equip=equipment,
    hot_water=servicehotwater,
    ventilation=ventilation,
    setpoint=setpoint)  # -> program; plug-in component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

geo = ClusterInput()

# ----
# Geometry
panel_8 = Panel("Hotel Shoebox")
roomsolid = HBRoomFromSolid(geo=flatten(geo), name=panel_8, constr_set=constructionset, program=programtype, conditioned=True)  # -> report, rooms; plug-in component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

# ----
# Chilled water loop
panel_9 = Panel("0")
objparams = IB_ObjParams(
    Coefficient1OfthePartLoadPerformanceCurve=panel_9,
    Coefficient2OfthePartLoadPerformanceCurve="0.0216",
    Coefficient3OfthePartLoadPerformanceCurve="-0.0325",
    Coefficient4OfthePartLoadPerformanceCurve="1.0095",
    DataFieldSetType="Ironbug.HVAC.IB_PumpVariableSpeed_FieldSet")
districtcooling = IB_DistrictCooling(dupNum=False)
pipeadiabatic = Ironbug_PipeAdiabatic(dupNum=False)
pumpvariable = Ironbug_PumpVariableSpeed(Parameters=objparams, dupNum=False)
plantbranches = PlantBranches(B1=districtcooling, B2=pipeadiabatic, mapBranchToLoop=False)
spm_scheduled = Ironbug_SetpointManagerScheduled(Temperature="6.7", dupNum=False)
plantbranches_2 = PlantBranches(mapBranchToLoop=False)
cwloop = Ironbug_ChilledWaterPlantLoop(Supply=[pumpvariable, plantbranches, spm_scheduled], Demand=plantbranches_2, dupNum=False)

objparams_2 = IB_ObjParams(DataFieldSetType="Ironbug.HVAC.IB_FanVariableVolume_FieldSet")

# ----
# DOAS
number_slider_3 = Slider(5, range=0..10)
thermalzone = IB_ThermalZone(_HBRooms=roomsolid.rooms, IsAirTerminalPriorToZoneEquipments=True, allowMultiAirloops=False, dupNum=False)
objparams_3 = IB_ObjParams(
    CentralHeatingMaximumSystemAirFlowRatio="1",
    TypeofLoadtoSizeOn="VentilationRequirement",
    DataFieldSetType="Ironbug.HVAC.IB_SizingSystem_FieldSet")
objparams_4 = IB_ObjParams(RatedCOP=number_slider_3, DataFieldSetType="Ironbug.HVAC.IB_CoilCoolingDXSingleSpeed_FieldSet")
oasystem = Ironbug_OutdoorAirSystem()
coilclndx1 = Ironbug_CoilCoolingDXSingleSpeed(Parameters_=objparams_4, dupNum=False)
coilhtngas = Ironbug_CoilHeatingGas(dupNum=False)
fanvariable = Ironbug_FanVariableVolume(Parameters_=objparams_2, dupNum=False)
spm_scheduled_2 = Ironbug_SetpointManagerScheduled(Temperature="21.11", dupNum=False)
airloopbranches = AirLoopBranches(Branch1=thermalzone)
objparams_5 = IB_ObjParams(Name="DOAS", DataFieldSetType="Ironbug.HVAC.IB_AirLoopHVAC_FieldSet")
sizingsystem = Ironbug_SizingSystem(Parameters_=objparams_3, dupNum=False)
merge = Merge(Data1=oasystem, Data2=coilclndx1, Data3=coilhtngas, Data4=fanvariable, Data5=spm_scheduled_2)
airloop = Ironbug_AirLoopHVAC(Supply=merge, Demand=airloopbranches, SizingSystem=sizingsystem, Parameters_=objparams_5, dupNum=False)

hvacsystem = IB_HVACSystem(AirLoops=flatten(airloop), PlantLoops=flatten(cwloop))
# District Cooling System
detailedhvac = HBDetailedHVAC(hb_objs=flatten(roomsolid.rooms), hvac_system=hvacsystem)  # -> report, hb_objs; plug-in component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

toggle = BooleanToggle(True)
solveadj = HBSolveAdjacency(rooms=flatten(detailedhvac.hb_objs), air_boundary=toggle, overwrite=toggle, run=toggle)  # -> report, adj_rooms; plug-in component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

# ----
# WWR
number_slider_4 = Slider(0.4, range=0..1)
aperturesbyratio = HBAperturesByRatio(hb_objs=flatten(solveadj.adj_rooms), ratio=number_slider_4, subdivide=Toggle(False))  # -> report, hb_objs; plug-in component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

weather_file = ClusterInput()

# ----
# Weather File (2000 - 2020)
toggle_2 = BooleanToggle(True)
simoutput = HBSimulationOutput(zone_energy_use=toggle_2, gains_and_losses=toggle_2, surface_energy_flow=toggle_2)  # -> report, sim_output; plug-in component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
epwtoddy = LBEPWToDDY(weather_file=weather_file, monthly_cool=toggle_2, write=toggle_2)  # -> ddy_file; plug-in component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
sizingpar = HBSizingParameter(ddy_file=epwtoddy, filter_ddays=toggle_2)  # -> sizing; plug-in component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
simpar = HBSimulationParameter(output=simoutput.sim_output, timestep=6, sizing=sizingpar)  # -> sim_par; plug-in component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

model = HBModel(rooms=flatten(aperturesbyratio.hb_objs), name="Hotel Archetype")  # -> report, model; plug-in component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
epw_file = ClusterInput()
run = ClusterInput()

# ----
# Run Simulation
toggle_3 = BooleanToggle(True)

modeltoosm = HBModelToOSM(model=model.model, epw_file=epw_file, sim_par=simpar, write=toggle_3, run=run)  # -> report, jsons, osw, osm, idf, sql, zsz, rdd, html; plug-in component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
idf = ClusterOutput(modeltoosm.idf)

eui = HBEndUseIntensity(sql=modeltoosm.sql, ip=Toggle(False))  # -> eui, eui_end_use, end_uses, gross_floor; plug-in component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

eui_2 = ClusterOutput(eui.eui)
eui_end_use = ClusterOutput(eui.eui_end_use)
end_uses = ClusterOutput(eui.end_uses)
gross_floor = ClusterOutput(eui.gross_floor)

# ==== cluster EnergySimLanded

# ----
# Schedule
panel = Panel("""0.92
0.82
0.74
0.68
0.64
0.63
0.66
0.64
0.58
0.53
0.00
0.00
0.00
0.00
0.00
0.00
0.00
0.00
0.00
0.70
0.80
0.95
1.00
0.98""")
panel_2 = Panel("""0.15
0.15
0.15
0.15
0.15
0.15
0.33
0.32
0.29
0.15
0.15
0.15
0.15
0.15
0.15
0.15
0.15
0.30
0.32
0.35
0.40
0.48
0.15
0.15""")
panel_3 = Panel("""120
120
120
120
120
120
120
120
120
120
120
120
120
120
120
120
120
120
120
120
120
120
120
120""")
panel_4 = Panel("""0.00
0.00
0.00
0.00
0.00
0.00
0.33
0.32
0.29
0.00
0.00
0.00
0.00
0.00
0.00
0.00
0.00
0.00
0.32
0.35
0.40
0.48
0.00
0.00""")
panel_5 = Panel("""20
20
20
20
20
20
20
20
20
20
20
20
20
20
20
20
20
20
20
20
20
20
20
20""")
panel_6 = Panel("""26
26
26
26
26
26
26
26
26
26
26
26
26
26
26
26
26
26
26
26
26
26
26
26""")
weeklyschedule = HBWeeklySchedule(
    sun=panel,
    mon=panel,
    tue=panel,
    wed=panel,
    thu=panel,
    fri=panel,
    sat=panel,
    name="Building Occupancy",
    type_limit="Fractional")  # -> report, schedule, idf_year, idf_week, idf_days; plug-in component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
constantschedule = HBConstantSchedule(values=panel_6, name="Cooling Setpoint", type_limit="Temperature")  # -> report, schedule, idf_text; plug-in component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
constantschedule_2 = HBConstantSchedule(values=panel_3, name="Activity Level", type_limit="Activity Level")  # -> report, schedule, idf_text; plug-in component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
constantschedule_3 = HBConstantSchedule(values=panel_2, name="Equipment", type_limit="Fractional")  # -> report, schedule, idf_text; plug-in component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
constantschedule_4 = HBConstantSchedule(values=panel_5, name="Heating Setpoint", type_limit="Temperature")  # -> report, schedule, idf_text; plug-in component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
constantschedule_5 = HBConstantSchedule(values=panel_4, name="Lighting and Hotwater", type_limit="Fractional")  # -> report, schedule, idf_text; plug-in component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

# ----
# Construction
number_slider = Slider(1.442, range=0..2)
opaquemat = HBOpaqueMaterial(
    name="walls",
    thickness=Slider(0.195, range=0..1),
    conductivity=Slider(0.303, range=0..1),
    density=Slider(1280, range=0..2000),
    spec_heat=Slider(840, range=0..2000))  # -> mat; plug-in component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
opaquemat_2 = HBOpaqueMaterial(
    name="exterior_floors",
    thickness=Slider(0.195, range=0..1),
    conductivity=number_slider,
    density=Slider(2240, range=0..3000),
    spec_heat=Slider(840, range=0..2000))  # -> mat; plug-in component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
opaquemat_3 = HBOpaqueMaterial(
    name="roofs",
    thickness=Slider(0.2, range=0..1),
    conductivity=Slider(0.303, range=0..1),
    density=Slider(1280, range=0..2000),
    spec_heat=Slider(840, range=0..2000))  # -> mat; plug-in component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
opaqueconstr = HBOpaqueConstruction(name="exterior_wall", materials=opaquemat)  # -> constr; plug-in component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
opaqueconstr_2 = HBOpaqueConstruction(name="exterior_roof", materials=opaquemat_3)  # -> constr; plug-in component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
opaqueconstr_3 = HBOpaqueConstruction(name="exposed_floors", materials=opaquemat_2)  # -> constr; plug-in component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
panel_7 = Panel("Tinted Single Glazing Glass")
windowmat = HBWindowMaterial(name=panel_7, u_factor=Slider(4.88, range=0..6), shgc=Slider(0.23, range=0..1))  # -> mat; plug-in component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
exteriorsubset = HBExteriorConstructionSubset(exterior_wall=opaqueconstr, exterior_roof=opaqueconstr_2, exposed_floor=opaqueconstr_3)  # -> exterior_set; plug-in component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
windowconstr = HBWindowConstruction(name=panel_7, materials=windowmat)  # -> constr; plug-in component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
subfacesubset = HBSubfaceSubset(window=windowconstr)  # -> subface_set; plug-in component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
constructionset = HBConstructionSet(name="SFH", exterior_subset=exteriorsubset, subface_subset=subfacesubset)  # -> constr_set; plug-in component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

# ----
# Building Progam
number_slider_2 = Slider(5.5, range=0..15)
setpoint = HBSetpoint(
    name="SFH Setpoint",
    heating_sch=constantschedule_4.schedule,
    cooling_sch=constantschedule.schedule,
    humid_setpt=Slider(40, range=0..100),
    dehumid_setpt=Slider(70, range=0..100))  # -> setpoint; plug-in component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
servicehotwater = HBServiceHotWater(name="SFH Hot Water", flow_per_area=Slider(0.041713, range=0..10), schedule=constantschedule_5.schedule)  # -> hot_water; plug-in component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
lighting = HBLighting(
    name="SFH Lighting",
    watts_per_area=number_slider_2,
    schedule=constantschedule_5.schedule,
    radiant_fract=Slider(0.2, range=0..6),
    visible_fract=Slider(0.7, range=0..6))  # -> lighting; plug-in component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
people = HBPeople(
    name="SFH People",
    ppl_per_area=Slider(0.0071, range=0..1),
    occupancy_sch=weeklyschedule.schedule,
    activity_sch=constantschedule_2.schedule,
    latent_fraction=Slider(0.3, range=0..1))  # -> people; plug-in component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
ventilation = HBVentilation(name="SFH Ventilation", ach=Slider(0.35, range=0..10), schedule=weeklyschedule.schedule)  # -> vent; plug-in component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
equipment = HBEquipment(
    name="SFH Equipment",
    watts_per_area=Slider(8, range=0..1000),
    schedule=constantschedule_3.schedule,
    radiant_fract=Slider(0.5, range=0..6),
    gas=Toggle(False))  # -> equip; plug-in component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
programtype = HBProgramType(
    name="SFH",
    people=people,
    lighting=lighting,
    electric_equip=equipment,
    hot_water=servicehotwater,
    ventilation=ventilation,
    setpoint=setpoint)  # -> program; plug-in component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

geo = ClusterInput()

# ----
# Geometry
panel_8 = Panel("SFH Shoebox")
roomsolid = HBRoomFromSolid(geo=flatten(geo), name=panel_8, constr_set=constructionset, program=programtype, conditioned=True)  # -> report, rooms; plug-in component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

# ----
# HVAC
number_slider_3 = Slider(0.7, range=0..1)
idealair = HBIdealAir(
    rooms=flatten(roomsolid.rooms),
    economizer="NoEconomizer",
    dcv=Toggle(True),
    sensible_hr=number_slider_3,
    latent_hr=Slider(0.65, range=0..1),
    cool_avail=weeklyschedule.schedule)  # -> report, rooms; plug-in component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

# ----
# Chilled water loop
panel_9 = Panel("0")
objparams = IB_ObjParams(
    Coefficient1OfthePartLoadPerformanceCurve=panel_9,
    Coefficient2OfthePartLoadPerformanceCurve="0.0216",
    Coefficient3OfthePartLoadPerformanceCurve="-0.0325",
    Coefficient4OfthePartLoadPerformanceCurve="1.0095",
    DataFieldSetType="Ironbug.HVAC.IB_PumpVariableSpeed_FieldSet")
districtcooling = IB_DistrictCooling(dupNum=False)
pipeadiabatic = Ironbug_PipeAdiabatic(dupNum=False)
pumpvariable = Ironbug_PumpVariableSpeed(Parameters=objparams, dupNum=False)
plantbranches = PlantBranches(B1=districtcooling, B2=pipeadiabatic, mapBranchToLoop=False)
spm_scheduled = Ironbug_SetpointManagerScheduled(Temperature="6.7", dupNum=False)
plantbranches_2 = PlantBranches(mapBranchToLoop=False)
cwloop = Ironbug_ChilledWaterPlantLoop(Supply=[pumpvariable, plantbranches, spm_scheduled], Demand=plantbranches_2, dupNum=False)

weather_file = ClusterInput()

# ----
# Weather File (2000 - 2020)
toggle = BooleanToggle(True)
epwtoddy = LBEPWToDDY(weather_file=weather_file, monthly_cool=toggle, write=toggle)  # -> ddy_file; plug-in component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
simoutput = HBSimulationOutput(zone_energy_use=toggle, gains_and_losses=toggle, surface_energy_flow=toggle)  # -> report, sim_output; plug-in component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
sizingpar = HBSizingParameter(ddy_file=epwtoddy, filter_ddays=toggle)  # -> sizing; plug-in component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
simpar = HBSimulationParameter(output=simoutput.sim_output, timestep=6, sizing=sizingpar)  # -> sim_par; plug-in component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

epw_file = ClusterInput()
run = ClusterInput()

# ----
# DOAS
number_slider_4 = Slider(3.5, range=0..10)
thermalzone = IB_ThermalZone(_HBRooms=roomsolid.rooms, IsAirTerminalPriorToZoneEquipments=True, allowMultiAirloops=False, dupNum=False)
objparams_2 = IB_ObjParams(
    CentralHeatingMaximumSystemAirFlowRatio="1",
    TypeofLoadtoSizeOn="VentilationRequirement",
    DataFieldSetType="Ironbug.HVAC.IB_SizingSystem_FieldSet")
objparams_3 = IB_ObjParams(RatedCOP=number_slider_4, DataFieldSetType="Ironbug.HVAC.IB_CoilCoolingDXSingleSpeed_FieldSet")
oasystem = Ironbug_OutdoorAirSystem()
coilclndx1 = Ironbug_CoilCoolingDXSingleSpeed(Parameters_=objparams_3, dupNum=False)
coilhtngas = Ironbug_CoilHeatingGas(dupNum=False)
spm_scheduled_2 = Ironbug_SetpointManagerScheduled(Temperature="21.11", dupNum=False)
airloopbranches = AirLoopBranches(Branch1=thermalzone)
objparams_4 = IB_ObjParams(Name="DOAS", DataFieldSetType="Ironbug.HVAC.IB_AirLoopHVAC_FieldSet")
sizingsystem = Ironbug_SizingSystem(Parameters_=objparams_2, dupNum=False)

# ----
# District Cooling System
objparams_5 = IB_ObjParams(DataFieldSetType="Ironbug.HVAC.IB_FanVariableVolume_FieldSet")

fanvariable = Ironbug_FanVariableVolume(Parameters_=objparams_5, dupNum=False)
merge = Merge(Data1=oasystem, Data2=coilclndx1, Data3=coilhtngas, Data4=fanvariable, Data5=spm_scheduled_2)
airloop = Ironbug_AirLoopHVAC(Supply=merge, Demand=airloopbranches, SizingSystem=sizingsystem, Parameters_=objparams_4, dupNum=False)

hvacsystem = IB_HVACSystem(AirLoops=flatten(airloop), PlantLoops=flatten(cwloop))
detailedhvac = HBDetailedHVAC(hb_objs=flatten(roomsolid.rooms), hvac_system=hvacsystem)  # -> report, hb_objs; plug-in component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

toggle_2 = BooleanToggle(True)
solveadj = HBSolveAdjacency(rooms=flatten(detailedhvac.hb_objs), air_boundary=toggle_2, overwrite=toggle_2, run=toggle_2)  # -> report, adj_rooms; plug-in component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

# ----
# WWR
number_slider_5 = Slider(0.4, range=0..1)
aperturesbyratio = HBAperturesByRatio(hb_objs=flatten(solveadj.adj_rooms), ratio=number_slider_5, subdivide=Toggle(False))  # -> report, hb_objs; plug-in component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

model = HBModel(rooms=flatten(aperturesbyratio.hb_objs), name="SFH Archetype")  # -> report, model; plug-in component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

# ----
# Run Simulation
toggle_3 = BooleanToggle(True)
modeltoosm = HBModelToOSM(model=model.model, epw_file=epw_file, sim_par=simpar, write=toggle_3, run=run)  # -> report, jsons, osw, osm, idf, sql, zsz, rdd, html; plug-in component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
toggle_4 = BooleanToggle(False)
eui = HBEndUseIntensity(sql=modeltoosm.sql, ip=toggle_4)  # -> eui, eui_end_use, end_uses, gross_floor; plug-in component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

eui_2 = HBEndUseIntensity(sql=modeltoosm.sql, ip=toggle_4)  # -> eui, eui_end_use, end_uses, gross_floor; plug-in component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
panel_10 = Panel(eui_2.eui)
panel_11 = Panel(eui_2.eui_end_use)
panel_12 = Panel(eui_2.end_uses)
panel_13 = Panel(eui_2.gross_floor)

idf = ClusterOutput(modeltoosm.idf)
eui_3 = ClusterOutput(eui.eui)
eui_end_use = ClusterOutput(eui.eui_end_use)
end_uses = ClusterOutput(eui.end_uses)
gross_floor = ClusterOutput(eui.gross_floor)

# ==== cluster EnergySimRetail

# ----
# Schedule
panel = Panel("""0.00
0.00
0.00
0.00
0.00
0.00
0.00
0.00
0.00
0.00
0.37
0.56
0.73
0.84
0.83
0.82
0.82
0.87
0.81
0.70
0.56
0.36
0.00
0.00""")
panel_2 = Panel("""0.00
0.00
0.00
0.00
0.00
0.00
0.00
0.00
0.00
0.00
0.26
0.41
0.53
0.60
0.57
0.54
0.55
0.58
0.62
0.58
0.50
0.38
0.00
0.00""")
panel_3 = Panel("""0.00
0.00
0.00
0.00
0.00
0.00
0.00
0.00
0.00
0.00
0.30
0.51
0.67
0.80
0.88
0.93
0.94
0.95
0.94
0.90
0.75
0.54
0.00
0.00""")
panel_4 = Panel("""120
120
120
120
120
120
120
120
120
120
120
120
120
120
120
120
120
120
120
120
120
120
120
120""")
panel_5 = Panel("""20
20
20
20
20
20
20
20
20
20
20
20
20
20
20
20
20
20
20
20
20
20
20
20""")
panel_6 = Panel("""26
26
26
26
26
26
26
26
26
26
26
26
26
26
26
26
26
26
26
26
26
26
26
26""")
weeklyschedule = HBWeeklySchedule(
    sun=panel,
    mon=panel_2,
    tue=panel_2,
    wed=panel_2,
    thu=panel_2,
    fri=panel_2,
    sat=panel_3,
    name="Building Occupancy",
    type_limit="Fractional")  # -> report, schedule, idf_year, idf_week, idf_days; plug-in component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
constantschedule = HBConstantSchedule(values=panel_6, name="Cooling Setpoint", type_limit="Temperature")  # -> report, schedule, idf_text; plug-in component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
constantschedule_2 = HBConstantSchedule(values=panel_4, name="Activity Level", type_limit="Activity Level")  # -> report, schedule, idf_text; plug-in component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
constantschedule_3 = HBConstantSchedule(values=panel_5, name="Heating Setpoint", type_limit="Temperature")  # -> report, schedule, idf_text; plug-in component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

panel_7 = Panel("Double Glazing with Low Emission Coating")

# ----
# Building Progam
number_slider = Slider(14, range=0..15)
setpoint = HBSetpoint(
    name="Retail Setpoint",
    heating_sch=constantschedule_3.schedule,
    cooling_sch=constantschedule.schedule,
    humid_setpt=Slider(40, range=0..100),
    dehumid_setpt=Slider(70, range=0..100))  # -> setpoint; plug-in component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
servicehotwater = HBServiceHotWater(name="Retail Hot Water", flow_per_area=Slider(0.14548, range=0..10), schedule=weeklyschedule.schedule)  # -> hot_water; plug-in component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
lighting = HBLighting(
    name="Retail Lighting",
    watts_per_area=number_slider,
    schedule=weeklyschedule.schedule,
    radiant_fract=Slider(0.2, range=0..6),
    visible_fract=Slider(0.7, range=0..6))  # -> lighting; plug-in component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
people = HBPeople(
    name="Retail People",
    ppl_per_area=Slider(0.2, range=0..1),
    occupancy_sch=weeklyschedule.schedule,
    activity_sch=constantschedule_2.schedule,
    latent_fraction=Slider(0.3, range=0..1))  # -> people; plug-in component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
ventilation = HBVentilation(name="Retail Ventilation", ach=Slider(6, range=0..10), schedule=weeklyschedule.schedule)  # -> vent; plug-in component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
equipment = HBEquipment(
    name="Retail Equipment",
    watts_per_area=Slider(15, range=0..1000),
    schedule=weeklyschedule.schedule,
    radiant_fract=Slider(0.5, range=0..6))  # -> equip; plug-in component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
programtype = HBProgramType(
    name="Hotel",
    people=people,
    lighting=lighting,
    electric_equip=equipment,
    hot_water=servicehotwater,
    ventilation=ventilation,
    setpoint=setpoint)  # -> program; plug-in component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

windowmat = HBWindowMaterial(name=panel_7, u_factor=Slider(1.6, range=0..6), shgc=Slider(0.12, range=0..1))  # -> mat; plug-in component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
windowconstr = HBWindowConstruction(name=panel_7, materials=windowmat)  # -> constr; plug-in component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
subfacesubset = HBSubfaceSubset(window=windowconstr)  # -> subface_set; plug-in component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

# ----
# Construction
number_slider_2 = Slider(1.442, range=0..2)
opaquemat = HBOpaqueMaterial(
    name="walls",
    thickness=Slider(0.125, range=0..1),
    conductivity=Slider(0.303, range=0..1),
    density=Slider(1280, range=0..2000),
    spec_heat=Slider(840, range=0..2000))  # -> mat; plug-in component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
opaquemat_2 = HBOpaqueMaterial(
    name="exterior_floors",
    thickness=Slider(0.25, range=0..1),
    conductivity=number_slider_2,
    density=Slider(2240, range=0..3000),
    spec_heat=Slider(840, range=0..2000))  # -> mat; plug-in component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
opaquemat_3 = HBOpaqueMaterial(
    name="roofs",
    thickness=Slider(0.25, range=0..1),
    conductivity=Slider(0.303, range=0..1),
    density=Slider(1280, range=0..2000),
    spec_heat=Slider(840, range=0..2000))  # -> mat; plug-in component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
opaqueconstr = HBOpaqueConstruction(name="exterior_wall", materials=opaquemat)  # -> constr; plug-in component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
opaqueconstr_2 = HBOpaqueConstruction(name="exterior_roof", materials=opaquemat_3)  # -> constr; plug-in component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
opaqueconstr_3 = HBOpaqueConstruction(name="exposed_floors", materials=opaquemat_2)  # -> constr; plug-in component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
exteriorsubset = HBExteriorConstructionSubset(exterior_wall=opaqueconstr, exterior_roof=opaqueconstr_2, exposed_floor=opaqueconstr_3)  # -> exterior_set; plug-in component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
constructionset = HBConstructionSet(name="Retail", exterior_subset=exteriorsubset, subface_subset=subfacesubset)  # -> constr_set; plug-in component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

geo = ClusterInput()

# ----
# Geometry
panel_8 = Panel("Retail Shoebox")
roomsolid = HBRoomFromSolid(geo=flatten(geo), name=panel_8, constr_set=constructionset, program=programtype, conditioned=True)  # -> report, rooms; plug-in component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

# ----
# Chilled water loop
panel_9 = Panel("0.0216")
objparams = IB_ObjParams(
    Coefficient1OfthePartLoadPerformanceCurve="0",
    Coefficient2OfthePartLoadPerformanceCurve=panel_9,
    Coefficient3OfthePartLoadPerformanceCurve="-0.0325",
    Coefficient4OfthePartLoadPerformanceCurve="1.0095",
    DataFieldSetType="Ironbug.HVAC.IB_PumpVariableSpeed_FieldSet")
districtcooling = IB_DistrictCooling(dupNum=False)
pipeadiabatic = Ironbug_PipeAdiabatic(dupNum=False)
pumpvariable = Ironbug_PumpVariableSpeed(Parameters=objparams, dupNum=False)
plantbranches = PlantBranches(B1=districtcooling, B2=pipeadiabatic, mapBranchToLoop=False)
spm_scheduled = Ironbug_SetpointManagerScheduled(Temperature="6.7", dupNum=False)
plantbranches_2 = PlantBranches(mapBranchToLoop=False)
cwloop = Ironbug_ChilledWaterPlantLoop(Supply=[pumpvariable, plantbranches, spm_scheduled], Demand=plantbranches_2, dupNum=False)

objparams_2 = IB_ObjParams(DataFieldSetType="Ironbug.HVAC.IB_FanVariableVolume_FieldSet")

# ----
# DOAS
number_slider_3 = Slider(3.5, range=0..10)
thermalzone = IB_ThermalZone(_HBRooms=roomsolid.rooms, IsAirTerminalPriorToZoneEquipments=True, allowMultiAirloops=False, dupNum=False)
objparams_3 = IB_ObjParams(
    CentralHeatingMaximumSystemAirFlowRatio="1",
    TypeofLoadtoSizeOn="VentilationRequirement",
    DataFieldSetType="Ironbug.HVAC.IB_SizingSystem_FieldSet")
objparams_4 = IB_ObjParams(RatedCOP=number_slider_3, DataFieldSetType="Ironbug.HVAC.IB_CoilCoolingDXSingleSpeed_FieldSet")
oasystem = Ironbug_OutdoorAirSystem()
coilclndx1 = Ironbug_CoilCoolingDXSingleSpeed(Parameters_=objparams_4, dupNum=False)
coilhtngas = Ironbug_CoilHeatingGas(dupNum=False)
fanvariable = Ironbug_FanVariableVolume(Parameters_=objparams_2, dupNum=False)
spm_scheduled_2 = Ironbug_SetpointManagerScheduled(Temperature="21.11", dupNum=False)
airloopbranches = AirLoopBranches(Branch1=thermalzone)
objparams_5 = IB_ObjParams(Name="DOAS", DataFieldSetType="Ironbug.HVAC.IB_AirLoopHVAC_FieldSet")
sizingsystem = Ironbug_SizingSystem(Parameters_=objparams_3, dupNum=False)
merge = Merge(Data1=oasystem, Data2=coilclndx1, Data3=coilhtngas, Data4=fanvariable, Data5=spm_scheduled_2)
airloop = Ironbug_AirLoopHVAC(Supply=merge, Demand=airloopbranches, SizingSystem=sizingsystem, Parameters_=objparams_5, dupNum=False)

hvacsystem = IB_HVACSystem(AirLoops=flatten(airloop), PlantLoops=flatten(cwloop))
# District Cooling System
detailedhvac = HBDetailedHVAC(hb_objs=flatten(roomsolid.rooms), hvac_system=hvacsystem)  # -> report, hb_objs; plug-in component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

toggle = BooleanToggle(True)
solveadj = HBSolveAdjacency(rooms=flatten(detailedhvac.hb_objs), air_boundary=toggle, overwrite=toggle, run=toggle)  # -> report, adj_rooms; plug-in component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

weather_file = ClusterInput()

# ----
# Weather File (2000 - 2020)
toggle_2 = BooleanToggle(True)
epwtoddy = LBEPWToDDY(weather_file=weather_file, monthly_cool=toggle_2, write=toggle_2)  # -> ddy_file; plug-in component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
simoutput = HBSimulationOutput(zone_energy_use=toggle_2, gains_and_losses=toggle_2, surface_energy_flow=toggle_2)  # -> report, sim_output; plug-in component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
sizingpar = HBSizingParameter(ddy_file=epwtoddy, filter_ddays=toggle_2)  # -> sizing; plug-in component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
simpar = HBSimulationParameter(output=simoutput.sim_output, timestep=6, sizing=sizingpar)  # -> sim_par; plug-in component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

# ----
# WWR
number_slider_4 = Slider(0.7, range=0..1)
aperturesbyratio = HBAperturesByRatio(hb_objs=flatten(solveadj.adj_rooms), ratio=number_slider_4, subdivide=Toggle(False))  # -> report, hb_objs; plug-in component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

# ----
# Model
panel_10 = Panel("Retail Archetype")
model = HBModel(rooms=flatten(aperturesbyratio.hb_objs), name=panel_10)  # -> report, model; plug-in component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

epw_file = ClusterInput()
run = ClusterInput()

# ----
# Run Simulation
toggle_3 = BooleanToggle(True)
modeltoosm = HBModelToOSM(model=model.model, epw_file=epw_file, sim_par=simpar, write=toggle_3, run=run)  # -> report, jsons, osw, osm, idf, sql, zsz, rdd, html; plug-in component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
eui = HBEndUseIntensity(sql=modeltoosm.sql, ip=Toggle(False))  # -> eui, eui_end_use, end_uses, gross_floor; plug-in component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

idf = ClusterOutput(modeltoosm.idf)
eui_2 = ClusterOutput(eui.eui)
eui_end_use = ClusterOutput(eui.eui_end_use)
end_uses = ClusterOutput(eui.end_uses)
gross_floor = ClusterOutput(eui.gross_floor)

# ==== cluster EnergySimOffice

# ----
# Schedule
panel = Panel("""0.00
0.00
0.00
0.00
0.00
0.00
0.00
0.00
0.00
0.00
0.00
0.00
0.00
0.00
0.00
0.00
0.00
0.00
0.00
0.00
0.00
0.00
0.00
0.00""")
panel_2 = Panel("""0.00
0.00
0.00
0.00
0.00
0.00
0.00
0.00
0.00
0.62
0.75
0.81
0.82
0.83
0.86
0.81
0.78
0.59
0.00
0.00
0.00
0.00
0.00
0.00""")
panel_3 = Panel("""0.00
0.00
0.00
0.00
0.00
0.00
0.00
0.00
0.00
0.00
0.00
0.00
0.00
0.00
0.00
0.00
0.00
0.00
0.00
0.00
0.00
0.00
0.00
0.00""")
panel_4 = Panel("""120
120
120
120
120
120
120
120
120
120
120
120
120
120
120
120
120
120
120
120
120
120
120
120""")
panel_5 = Panel("""20
20
20
20
20
20
20
20
20
20
20
20
20
20
20
20
20
20
20
20
20
20
20
20""")
panel_6 = Panel("""26
26
26
26
26
26
26
26
26
26
26
26
26
26
26
26
26
26
26
26
26
26
26
26""")
weeklyschedule = HBWeeklySchedule(
    sun=panel,
    mon=panel_2,
    tue=panel_2,
    wed=panel_2,
    thu=panel_2,
    fri=panel_2,
    sat=panel_3,
    name="Building Occupancy",
    type_limit="Fractional")  # -> report, schedule, idf_year, idf_week, idf_days; plug-in component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
constantschedule = HBConstantSchedule(values=panel_6, name="Cooling Setpoint", type_limit="Temperature")  # -> report, schedule, idf_text; plug-in component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
constantschedule_2 = HBConstantSchedule(values=panel_4, name="Activity Level", type_limit="Activity Level")  # -> report, schedule, idf_text; plug-in component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
constantschedule_3 = HBConstantSchedule(values=panel_5, name="Heating Setpoint", type_limit="Temperature")  # -> report, schedule, idf_text; plug-in component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

# ----
# Construction
number_slider = Slider(1.442, range=0..2)
opaquemat = HBOpaqueMaterial(
    name="walls",
    thickness=Slider(0.125, range=0..1),
    conductivity=Slider(0.303, range=0..1),
    density=Slider(1280, range=0..2000),
    spec_heat=Slider(840, range=0..2000))  # -> mat; plug-in component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
opaquemat_2 = HBOpaqueMaterial(
    name="exterior_floors",
    thickness=Slider(0.25, range=0..1),
    conductivity=number_slider,
    density=Slider(2240, range=0..3000),
    spec_heat=Slider(840, range=0..2000))  # -> mat; plug-in component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
opaquemat_3 = HBOpaqueMaterial(
    name="roofs",
    thickness=Slider(0.25, range=0..1),
    conductivity=Slider(0.303, range=0..1),
    density=Slider(1280, range=0..2000),
    spec_heat=Slider(840, range=0..2000))  # -> mat; plug-in component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
opaqueconstr = HBOpaqueConstruction(name="exterior_wall", materials=opaquemat)  # -> constr; plug-in component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
opaqueconstr_2 = HBOpaqueConstruction(name="exterior_roof", materials=opaquemat_3)  # -> constr; plug-in component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
opaqueconstr_3 = HBOpaqueConstruction(name="exposed_floors", materials=opaquemat_2)  # -> constr; plug-in component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
panel_7 = Panel("Double Glazing with Low Emission Coating")
windowmat = HBWindowMaterial(name=panel_7, u_factor=Slider(1.6, range=0..6), shgc=Slider(0.12, range=0..1))  # -> mat; plug-in component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
exteriorsubset = HBExteriorConstructionSubset(exterior_wall=opaqueconstr, exterior_roof=opaqueconstr_2, exposed_floor=opaqueconstr_3)  # -> exterior_set; plug-in component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
windowconstr = HBWindowConstruction(name=panel_7, materials=windowmat)  # -> constr; plug-in component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
subfacesubset = HBSubfaceSubset(window=windowconstr)  # -> subface_set; plug-in component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
constructionset = HBConstructionSet(name="Office", exterior_subset=exteriorsubset, subface_subset=subfacesubset)  # -> constr_set; plug-in component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

# ----
# Building Progam
number_slider_2 = Slider(12, range=0..15)
setpoint = HBSetpoint(
    name="Office Setpoint",
    heating_sch=constantschedule_3.schedule,
    cooling_sch=constantschedule.schedule,
    humid_setpt=Slider(40, range=0..100),
    dehumid_setpt=Slider(70, range=0..100))  # -> setpoint; plug-in component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
servicehotwater = HBServiceHotWater(name="Office Hot Water", flow_per_area=Slider(0.034552, range=0..10), schedule=weeklyschedule.schedule)  # -> hot_water; plug-in component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
lighting = HBLighting(
    name="Office Lighting",
    watts_per_area=number_slider_2,
    schedule=weeklyschedule.schedule,
    radiant_fract=Slider(0.2, range=0..6),
    visible_fract=Slider(0.7, range=0..6))  # -> lighting; plug-in component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
people = HBPeople(
    name="Office People",
    ppl_per_area=Slider(0.047501, range=0..1),
    occupancy_sch=weeklyschedule.schedule,
    activity_sch=constantschedule_2.schedule,
    latent_fraction=Slider(0.3, range=0..1))  # -> people; plug-in component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
ventilation = HBVentilation(name="Office Ventilation", ach=Slider(6, range=0..10), schedule=weeklyschedule.schedule)  # -> vent; plug-in component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
equipment = HBEquipment(
    name="Office Equipment",
    watts_per_area=Slider(22, range=0..1000),
    schedule=weeklyschedule.schedule,
    radiant_fract=Slider(0.5, range=0..6),
    gas=Toggle(False))  # -> equip; plug-in component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
programtype = HBProgramType(
    name="Office",
    people=people,
    lighting=lighting,
    electric_equip=equipment,
    hot_water=servicehotwater,
    ventilation=ventilation,
    setpoint=setpoint)  # -> program; plug-in component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

# ----
# Chilled water loop
panel_8 = Panel("0.0216")
objparams = IB_ObjParams(
    Coefficient1OfthePartLoadPerformanceCurve="0",
    Coefficient2OfthePartLoadPerformanceCurve=panel_8,
    Coefficient3OfthePartLoadPerformanceCurve="-0.0325",
    Coefficient4OfthePartLoadPerformanceCurve="1.0095",
    DataFieldSetType="Ironbug.HVAC.IB_PumpVariableSpeed_FieldSet")
districtcooling = IB_DistrictCooling(dupNum=False)
pipeadiabatic = Ironbug_PipeAdiabatic(dupNum=False)
pumpvariable = Ironbug_PumpVariableSpeed(Parameters=objparams, dupNum=False)
plantbranches = PlantBranches(B1=districtcooling, B2=pipeadiabatic, mapBranchToLoop=False)
spm_scheduled = Ironbug_SetpointManagerScheduled(Temperature="6.7", dupNum=False)
plantbranches_2 = PlantBranches(mapBranchToLoop=False)
cwloop = Ironbug_ChilledWaterPlantLoop(Supply=[pumpvariable, plantbranches, spm_scheduled], Demand=plantbranches_2, dupNum=False)

geo = ClusterInput()

# ----
# Geometry
panel_9 = Panel("Office Shoebox")
roomsolid = HBRoomFromSolid(geo=flatten(geo), name=panel_9, constr_set=constructionset, program=programtype, conditioned=True)  # -> report, rooms; plug-in component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

# ----
# DOAS
number_slider_3 = Slider(5, range=0..10)
thermalzone = IB_ThermalZone(_HBRooms=roomsolid.rooms, IsAirTerminalPriorToZoneEquipments=True, allowMultiAirloops=False, dupNum=False)
objparams_2 = IB_ObjParams(
    CentralHeatingMaximumSystemAirFlowRatio="1",
    TypeofLoadtoSizeOn="VentilationRequirement",
    DataFieldSetType="Ironbug.HVAC.IB_SizingSystem_FieldSet")
objparams_3 = IB_ObjParams(RatedCOP=number_slider_3, DataFieldSetType="Ironbug.HVAC.IB_CoilCoolingDXSingleSpeed_FieldSet")
oasystem = Ironbug_OutdoorAirSystem()
coilclndx1 = Ironbug_CoilCoolingDXSingleSpeed(Parameters_=objparams_3, dupNum=False)
coilhtngas = Ironbug_CoilHeatingGas(dupNum=False)
fanvariable = Ironbug_FanVariableVolume(dupNum=False)
spm_scheduled_2 = Ironbug_SetpointManagerScheduled(Temperature="21.11", dupNum=False)
airloopbranches = AirLoopBranches(Branch1=thermalzone)
objparams_4 = IB_ObjParams(Name="DOAS", DataFieldSetType="Ironbug.HVAC.IB_AirLoopHVAC_FieldSet")
sizingsystem = Ironbug_SizingSystem(Parameters_=objparams_2, dupNum=False)
merge = Merge(Data1=oasystem, Data2=coilclndx1, Data3=coilhtngas, Data4=fanvariable, Data5=spm_scheduled_2)
airloop = Ironbug_AirLoopHVAC(Supply=merge, Demand=airloopbranches, SizingSystem=sizingsystem, Parameters_=objparams_4, dupNum=False)

hvacsystem = IB_HVACSystem(AirLoops=flatten(airloop), PlantLoops=flatten(cwloop))
# District Cooling System
detailedhvac = HBDetailedHVAC(hb_objs=flatten(roomsolid.rooms), hvac_system=hvacsystem)  # -> report, hb_objs; plug-in component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

toggle = BooleanToggle(True)
solveadj = HBSolveAdjacency(rooms=flatten(detailedhvac.hb_objs), air_boundary=toggle, overwrite=toggle, run=toggle)  # -> report, adj_rooms; plug-in component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

weather_file = ClusterInput()

# ----
# Weather File (2000 - 2020)
toggle_2 = BooleanToggle(True)
epwtoddy = LBEPWToDDY(weather_file=weather_file, monthly_cool=toggle_2, write=toggle_2)  # -> ddy_file; plug-in component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
simoutput = HBSimulationOutput(zone_energy_use=toggle_2, gains_and_losses=toggle_2, surface_energy_flow=toggle_2)  # -> report, sim_output; plug-in component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
sizingpar = HBSizingParameter(ddy_file=epwtoddy, filter_ddays=toggle_2)  # -> sizing; plug-in component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
simpar = HBSimulationParameter(output=simoutput.sim_output, timestep=6, sizing=sizingpar)  # -> sim_par; plug-in component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

# ----
# WWR
number_slider_4 = Slider(0.7, range=0..1)
aperturesbyratio = HBAperturesByRatio(hb_objs=flatten(solveadj.adj_rooms), ratio=number_slider_4, subdivide=Toggle(False))  # -> report, hb_objs; plug-in component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

model = HBModel(rooms=flatten(aperturesbyratio.hb_objs), name="Office Archetype")  # -> report, model; plug-in component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
epw_file = ClusterInput()
run = ClusterInput()

# ----
# Run Simulation
toggle_3 = BooleanToggle(True)
modeltoosm = HBModelToOSM(model=model.model, epw_file=epw_file, sim_par=simpar, write=toggle_3, run=run)  # -> report, jsons, osw, osm, idf, sql, zsz, rdd, html; plug-in component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
eui = HBEndUseIntensity(sql=modeltoosm.sql, ip=Toggle(True))  # -> eui, eui_end_use, end_uses, gross_floor; plug-in component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

idf = ClusterOutput(modeltoosm.idf)
eui_2 = ClusterOutput(eui.eui)
eui_end_use = ClusterOutput(eui.eui_end_use)
end_uses = ClusterOutput(eui.end_uses)
gross_floor = ClusterOutput(eui.gross_floor)

# ==== cluster EnergySimHospital

# ----
# Schedule
panel = Panel("""0.15
0.12
0.10
0.09
0.08
0.10
0.16
0.20
0.37
0.48
0.60
0.61
0.68
0.73
0.79
0.73
0.69
0.56
0.44
0.34
0.37
0.20
0.23
0.23""")
panel_2 = Panel("""0.16
0.12
0.07
0.00
0.07
0.08
0.11
0.20
0.26
0.20
0.26
0.15
0.49
0.28
0.15
0.18
0.20
0.23
0.22
0.50
0.38
0.21
0.11
0.07""")
panel_3 = Panel("""0.08
0.05
0.07
0.09
0.08
0.07
0.04
0.07
0.06
0.14
0.10
0.13
0.20
0.20
0.25
0.24
0.28
0.19
0.11
0.12
0.19
0.25
0.15
0.15""")
panel_4 = Panel("""120
120
120
120
120
120
120
120
120
120
120
120
120
120
120
120
120
120
120
120
120
120
120
120""")
panel_5 = Panel("""20
20
20
20
20
20
20
20
20
20
20
20
20
20
20
20
20
20
20
20
20
20
20
20""")
panel_6 = Panel("""26
26
26
26
26
26
26
26
26
26
26
26
26
26
26
26
26
26
26
26
26
26
26
26""")
weeklyschedule = HBWeeklySchedule(
    sun=panel_3,
    mon=panel,
    tue=panel,
    wed=panel,
    thu=panel,
    fri=panel,
    sat=panel_2,
    name="Building Occupancy",
    type_limit="Fractional")  # -> report, schedule, idf_year, idf_week, idf_days; plug-in component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
constantschedule = HBConstantSchedule(values=panel_6, name="Cooling Setpoint", type_limit="Temperature")  # -> report, schedule, idf_text; plug-in component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
constantschedule_2 = HBConstantSchedule(values=panel_4, name="Activity Level", type_limit="Activity Level")  # -> report, schedule, idf_text; plug-in component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
constantschedule_3 = HBConstantSchedule(values=panel_5, name="Heating Setpoint", type_limit="Temperature")  # -> report, schedule, idf_text; plug-in component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

# ----
# Construction
number_slider = Slider(1.442, range=0..2)
opaquemat = HBOpaqueMaterial(
    name="walls",
    thickness=Slider(0.125, range=0..1),
    conductivity=Slider(0.303, range=0..1),
    density=Slider(1280, range=0..2000),
    spec_heat=Slider(840, range=0..2000))  # -> mat; plug-in component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
opaquemat_2 = HBOpaqueMaterial(
    name="exterior_floors",
    thickness=Slider(0.25, range=0..1),
    conductivity=number_slider,
    density=Slider(2240, range=0..3000),
    spec_heat=Slider(840, range=0..2000))  # -> mat; plug-in component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
opaquemat_3 = HBOpaqueMaterial(
    name="roofs",
    thickness=Slider(0.25, range=0..1),
    conductivity=Slider(0.303, range=0..1),
    density=Slider(1280, range=0..2000),
    spec_heat=Slider(840, range=0..2000))  # -> mat; plug-in component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
opaqueconstr = HBOpaqueConstruction(name="exterior_wall", materials=opaquemat)  # -> constr; plug-in component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
opaqueconstr_2 = HBOpaqueConstruction(name="exterior_roof", materials=opaquemat_3)  # -> constr; plug-in component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
opaqueconstr_3 = HBOpaqueConstruction(name="exposed_floors", materials=opaquemat_2)  # -> constr; plug-in component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
panel_7 = Panel("Double Glazing with Low Emission Coating")
exteriorsubset = HBExteriorConstructionSubset(exterior_wall=opaqueconstr, exterior_roof=opaqueconstr_2, exposed_floor=opaqueconstr_3)  # -> exterior_set; plug-in component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
windowmat = HBWindowMaterial(name=panel_7, u_factor=Slider(1.6, range=0..6), shgc=Slider(0.12, range=0..1))  # -> mat; plug-in component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
windowconstr = HBWindowConstruction(name=panel_7, materials=windowmat)  # -> constr; plug-in component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
subfacesubset = HBSubfaceSubset(window=windowconstr)  # -> subface_set; plug-in component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
constructionset = HBConstructionSet(name="Hospital", exterior_subset=exteriorsubset, subface_subset=subfacesubset)  # -> constr_set; plug-in component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

# ----
# Building Progam
number_slider_2 = Slider(11, range=0..15)
setpoint = HBSetpoint(
    name="Hospital Setpoint",
    heating_sch=constantschedule_3.schedule,
    cooling_sch=constantschedule.schedule,
    humid_setpt=Slider(40, range=0..100),
    dehumid_setpt=Slider(70, range=0..100))  # -> setpoint; plug-in component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
servicehotwater = HBServiceHotWater(name="Hospital Hot Water", flow_per_area=Slider(0.055965, range=0..10), schedule=weeklyschedule.schedule)  # -> hot_water; plug-in component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
lighting = HBLighting(
    name="Hospital Lighting",
    watts_per_area=number_slider_2,
    schedule=weeklyschedule.schedule,
    radiant_fract=Slider(0.2, range=0..6),
    visible_fract=Slider(0.7, range=0..6))  # -> lighting; plug-in component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
people = HBPeople(
    name="Hospital People",
    ppl_per_area=Slider(0.076939, range=0..1),
    occupancy_sch=weeklyschedule.schedule,
    activity_sch=constantschedule_2.schedule,
    latent_fraction=Slider(0.3, range=0..1))  # -> people; plug-in component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
ventilation = HBVentilation(name="Hospital Ventilation", ach=Slider(6, range=0..10), schedule=weeklyschedule.schedule)  # -> vent; plug-in component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
equipment = HBEquipment(
    name="Hospital Equipment",
    watts_per_area=Slider(15, range=0..1000),
    schedule=weeklyschedule.schedule,
    radiant_fract=Slider(0.5, range=0..6),
    gas=Toggle(False))  # -> equip; plug-in component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
programtype = HBProgramType(
    name="Hospital",
    people=people,
    lighting=lighting,
    electric_equip=equipment,
    hot_water=servicehotwater,
    ventilation=ventilation,
    setpoint=setpoint)  # -> program; plug-in component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

geo = ClusterInput()

# ----
# Geometry
panel_8 = Panel("Hospital Shoebox")
roomsolid = HBRoomFromSolid(geo=flatten(geo), name=panel_8, constr_set=constructionset, program=programtype, conditioned=True)  # -> report, rooms; plug-in component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

# ----
# Chilled water loop
panel_9 = Panel("0.0216")
objparams = IB_ObjParams(
    Coefficient1OfthePartLoadPerformanceCurve="0",
    Coefficient2OfthePartLoadPerformanceCurve=panel_9,
    Coefficient3OfthePartLoadPerformanceCurve="-0.0325",
    Coefficient4OfthePartLoadPerformanceCurve="1.0095",
    DataFieldSetType="Ironbug.HVAC.IB_PumpVariableSpeed_FieldSet")
districtcooling = IB_DistrictCooling(dupNum=False)
pipeadiabatic = Ironbug_PipeAdiabatic(dupNum=False)
pumpvariable = Ironbug_PumpVariableSpeed(Parameters=objparams, dupNum=False)
plantbranches = PlantBranches(B1=districtcooling, B2=pipeadiabatic, mapBranchToLoop=False)
spm_scheduled = Ironbug_SetpointManagerScheduled(Temperature="6.7", dupNum=False)
plantbranches_2 = PlantBranches(mapBranchToLoop=False)
cwloop = Ironbug_ChilledWaterPlantLoop(Supply=[pumpvariable, plantbranches, spm_scheduled], Demand=plantbranches_2, dupNum=False)

weather_file = ClusterInput()

# ----
# Weather File (2000 - 2020)
toggle = BooleanToggle(True)
epwtoddy = LBEPWToDDY(weather_file=weather_file, monthly_cool=toggle, write=toggle)  # -> ddy_file; plug-in component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
simoutput = HBSimulationOutput(zone_energy_use=toggle, gains_and_losses=toggle, surface_energy_flow=toggle)  # -> report, sim_output; plug-in component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
sizingpar = HBSizingParameter(ddy_file=epwtoddy, filter_ddays=toggle)  # -> sizing; plug-in component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
simpar = HBSimulationParameter(output=simoutput.sim_output, timestep=6, sizing=sizingpar)  # -> sim_par; plug-in component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

epw_file = ClusterInput()
run = ClusterInput()

# ----
# DOAS
number_slider_3 = Slider(4, range=0..10)
thermalzone = IB_ThermalZone(_HBRooms=roomsolid.rooms, IsAirTerminalPriorToZoneEquipments=True, allowMultiAirloops=False, dupNum=False)
objparams_2 = IB_ObjParams(
    CentralHeatingMaximumSystemAirFlowRatio="1",
    TypeofLoadtoSizeOn="VentilationRequirement",
    DataFieldSetType="Ironbug.HVAC.IB_SizingSystem_FieldSet")
objparams_3 = IB_ObjParams(RatedCOP=number_slider_3, DataFieldSetType="Ironbug.HVAC.IB_CoilCoolingDXSingleSpeed_FieldSet")
oasystem = Ironbug_OutdoorAirSystem()
coilclndx1 = Ironbug_CoilCoolingDXSingleSpeed(Parameters_=objparams_3, dupNum=False)
coilhtngas = Ironbug_CoilHeatingGas(dupNum=False)
spm_scheduled_2 = Ironbug_SetpointManagerScheduled(Temperature="21.11", dupNum=False)
airloopbranches = AirLoopBranches(Branch1=thermalzone)
objparams_4 = IB_ObjParams(Name="DOAS", DataFieldSetType="Ironbug.HVAC.IB_AirLoopHVAC_FieldSet")
sizingsystem = Ironbug_SizingSystem(Parameters_=objparams_2, dupNum=False)

# ----
# District Cooling System
objparams_5 = IB_ObjParams(DataFieldSetType="Ironbug.HVAC.IB_FanVariableVolume_FieldSet")

fanvariable = Ironbug_FanVariableVolume(Parameters_=objparams_5, dupNum=False)
merge = Merge(Data1=oasystem, Data2=coilclndx1, Data3=coilhtngas, Data4=fanvariable, Data5=spm_scheduled_2)
airloop = Ironbug_AirLoopHVAC(Supply=merge, Demand=airloopbranches, SizingSystem=sizingsystem, Parameters_=objparams_4, dupNum=False)

hvacsystem = IB_HVACSystem(AirLoops=flatten(airloop), PlantLoops=flatten(cwloop))
detailedhvac = HBDetailedHVAC(hb_objs=flatten(roomsolid.rooms), hvac_system=hvacsystem)  # -> report, hb_objs; plug-in component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

toggle_2 = BooleanToggle(True)
solveadj = HBSolveAdjacency(rooms=flatten(detailedhvac.hb_objs), air_boundary=toggle_2, overwrite=toggle_2, run=toggle_2)  # -> report, adj_rooms; plug-in component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

# ----
# WWR
number_slider_4 = Slider(0.4, range=0..1)
aperturesbyratio = HBAperturesByRatio(hb_objs=flatten(solveadj.adj_rooms), ratio=number_slider_4, subdivide=Toggle(False))  # -> report, hb_objs; plug-in component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

model = HBModel(rooms=flatten(aperturesbyratio.hb_objs), name="Hospital Archetype")  # -> report, model; plug-in component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

# ----
# Run Simulation
toggle_3 = BooleanToggle(True)
modeltoosm = HBModelToOSM(model=model.model, epw_file=epw_file, sim_par=simpar, write=toggle_3, run=run)  # -> report, jsons, osw, osm, idf, sql, zsz, rdd, html; plug-in component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
eui = HBEndUseIntensity(sql=modeltoosm.sql, ip=Toggle(True))  # -> eui, eui_end_use, end_uses, gross_floor; plug-in component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

idf = ClusterOutput(modeltoosm.idf)
eui_2 = ClusterOutput(eui.eui)
eui_end_use = ClusterOutput(eui.eui_end_use)
end_uses = ClusterOutput(eui.end_uses)
gross_floor = ClusterOutput(eui.gross_floor)

# ==== cluster EnergySimClinic

# ----
# Schedule
panel = Panel("""0.00
0.00
0.00
0.00
0.00
0.00
0.00
0.00
0.69
0.91
0.94
0.81
0.64
0.00
0.59
0.58
0.40
0.00
0.00
0.00
0.00
0.00
0.00
0.00""")
panel_2 = Panel("""0.00
0.00
0.00
0.00
0.00
0.00
0.00
0.00
0.56
0.69
0.69
0.54
0.34
0.00
0.00
0.00
0.00
0.00
0.00
0.00
0.00
0.00
0.00
0.00""")
panel_3 = Panel("""0.00
0.00
0.00
0.00
0.00
0.00
0.00
0.00
0.00
0.00
0.00
0.00
0.00
0.00
0.00
0.00
0.00
0.00
0.00
0.00
0.00
0.00
0.00
0.00""")
panel_4 = Panel("""120
120
120
120
120
120
120
120
120
120
120
120
120
120
120
120
120
120
120
120
120
120
120
120""")
panel_5 = Panel("""20
20
20
20
20
20
20
20
20
20
20
20
20
20
20
20
20
20
20
20
20
20
20
20""")
panel_6 = Panel("""26
26
26
26
26
26
26
26
26
26
26
26
26
26
26
26
26
26
26
26
26
26
26
26""")
weeklyschedule = HBWeeklySchedule(
    sun=panel_3,
    mon=panel,
    tue=panel,
    wed=panel,
    thu=panel,
    fri=panel,
    sat=panel_2,
    name="Building Occupancy",
    type_limit="Fractional")  # -> report, schedule, idf_year, idf_week, idf_days; plug-in component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
constantschedule = HBConstantSchedule(values=panel_6, name="Cooling Setpoint", type_limit="Temperature")  # -> report, schedule, idf_text; plug-in component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
constantschedule_2 = HBConstantSchedule(values=panel_4, name="Activity Level", type_limit="Activity Level")  # -> report, schedule, idf_text; plug-in component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
constantschedule_3 = HBConstantSchedule(values=panel_5, name="Heating Setpoint", type_limit="Temperature")  # -> report, schedule, idf_text; plug-in component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

# ----
# Construction
number_slider = Slider(1.442, range=0..2)
opaquemat = HBOpaqueMaterial(
    name="walls",
    thickness=Slider(0.125, range=0..1),
    conductivity=Slider(0.303, range=0..1),
    density=Slider(1280, range=0..2000),
    spec_heat=Slider(840, range=0..2000))  # -> mat; plug-in component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
opaquemat_2 = HBOpaqueMaterial(
    name="exterior_floors",
    thickness=Slider(0.25, range=0..1),
    conductivity=number_slider,
    density=Slider(2240, range=0..3000),
    spec_heat=Slider(840, range=0..2000))  # -> mat; plug-in component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
opaquemat_3 = HBOpaqueMaterial(
    name="roofs",
    thickness=Slider(0.25, range=0..1),
    conductivity=Slider(0.303, range=0..1),
    density=Slider(1280, range=0..2000),
    spec_heat=Slider(840, range=0..2000))  # -> mat; plug-in component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
opaqueconstr = HBOpaqueConstruction(name="exterior_wall", materials=opaquemat)  # -> constr; plug-in component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
opaqueconstr_2 = HBOpaqueConstruction(name="exterior_roof", materials=opaquemat_3)  # -> constr; plug-in component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
opaqueconstr_3 = HBOpaqueConstruction(name="exposed_floors", materials=opaquemat_2)  # -> constr; plug-in component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
panel_7 = Panel("Double Glazing with Low Emission Coating")
exteriorsubset = HBExteriorConstructionSubset(exterior_wall=opaqueconstr, exterior_roof=opaqueconstr_2, exposed_floor=opaqueconstr_3)  # -> exterior_set; plug-in component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
windowmat = HBWindowMaterial(name=panel_7, u_factor=Slider(1.6, range=0..6), shgc=Slider(0.12, range=0..1))  # -> mat; plug-in component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
windowconstr = HBWindowConstruction(name=panel_7, materials=windowmat)  # -> constr; plug-in component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
subfacesubset = HBSubfaceSubset(window=windowconstr)  # -> subface_set; plug-in component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
constructionset = HBConstructionSet(name="Polyclinic", exterior_subset=exteriorsubset, subface_subset=subfacesubset)  # -> constr_set; plug-in component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

# ----
# Building Progam
number_slider_2 = Slider(6, range=0..15)
setpoint = HBSetpoint(
    name="Polyclinic Setpoint",
    heating_sch=constantschedule_3.schedule,
    cooling_sch=constantschedule.schedule,
    humid_setpt=Slider(40, range=0..100),
    dehumid_setpt=Slider(70, range=0..100))  # -> setpoint; plug-in component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
servicehotwater = HBServiceHotWater(name="Polyclinic Hot Water", flow_per_area=Slider(0.03229, range=0..10), schedule=weeklyschedule.schedule)  # -> hot_water; plug-in component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
lighting = HBLighting(
    name="Polyclinic Lighting",
    watts_per_area=number_slider_2,
    schedule=weeklyschedule.schedule,
    radiant_fract=Slider(0.2, range=0..6),
    visible_fract=Slider(0.7, range=0..6))  # -> lighting; plug-in component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
people = HBPeople(
    name="Polyclinic People",
    ppl_per_area=Slider(0.044392, range=0..1),
    occupancy_sch=weeklyschedule.schedule,
    activity_sch=constantschedule_2.schedule,
    latent_fraction=Slider(0.3, range=0..1))  # -> people; plug-in component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
ventilation = HBVentilation(name="Polyclinic Ventilation", ach=Slider(4, range=0..10), schedule=weeklyschedule.schedule)  # -> vent; plug-in component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
equipment = HBEquipment(
    name="Polyclinic Equipment",
    watts_per_area=Slider(13, range=0..1000),
    schedule=weeklyschedule.schedule,
    radiant_fract=Slider(0.5, range=0..6),
    gas=Toggle(False))  # -> equip; plug-in component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
programtype = HBProgramType(
    name="Polyclinic",
    people=people,
    lighting=lighting,
    electric_equip=equipment,
    hot_water=servicehotwater,
    ventilation=ventilation,
    setpoint=setpoint)  # -> program; plug-in component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

# ----
# Chilled water loop
panel_8 = Panel("0")
objparams = IB_ObjParams(
    Coefficient1OfthePartLoadPerformanceCurve=panel_8,
    Coefficient2OfthePartLoadPerformanceCurve="0.0216",
    Coefficient3OfthePartLoadPerformanceCurve="-0.0325",
    Coefficient4OfthePartLoadPerformanceCurve="1.0095",
    DataFieldSetType="Ironbug.HVAC.IB_PumpVariableSpeed_FieldSet")
districtcooling = IB_DistrictCooling(dupNum=False)
pipeadiabatic = Ironbug_PipeAdiabatic(dupNum=False)
pumpvariable = Ironbug_PumpVariableSpeed(Parameters=objparams, dupNum=False)
plantbranches = PlantBranches(B1=districtcooling, B2=pipeadiabatic, mapBranchToLoop=False)
spm_scheduled = Ironbug_SetpointManagerScheduled(Temperature="6.7", dupNum=False)
plantbranches_2 = PlantBranches(mapBranchToLoop=False)
cwloop = Ironbug_ChilledWaterPlantLoop(Supply=[pumpvariable, plantbranches, spm_scheduled], Demand=plantbranches_2, dupNum=False)

geo = ClusterInput()

# ----
# Geometry
panel_9 = Panel("Polyclinic Shoebox")
roomsolid = HBRoomFromSolid(geo=flatten(geo), name=panel_9, constr_set=constructionset, program=programtype, conditioned=True)  # -> report, rooms; plug-in component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

weather_file = ClusterInput()

# ----
# Weather File (2000 - 2020)
toggle = BooleanToggle(True)
simoutput = HBSimulationOutput(zone_energy_use=toggle, gains_and_losses=toggle, surface_energy_flow=toggle)  # -> report, sim_output; plug-in component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
epwtoddy = LBEPWToDDY(weather_file=weather_file, monthly_cool=toggle, write=toggle)  # -> ddy_file; plug-in component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
sizingpar = HBSizingParameter(ddy_file=epwtoddy, filter_ddays=toggle)  # -> sizing; plug-in component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
simpar = HBSimulationParameter(output=simoutput.sim_output, timestep=6, sizing=sizingpar)  # -> sim_par; plug-in component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

epw_file = ClusterInput()
run = ClusterInput()

# ----
# DOAS
number_slider_3 = Slider(4, range=0..10)
thermalzone = IB_ThermalZone(_HBRooms=roomsolid.rooms, IsAirTerminalPriorToZoneEquipments=True, allowMultiAirloops=False, dupNum=False)
objparams_2 = IB_ObjParams(
    CentralHeatingMaximumSystemAirFlowRatio="1",
    TypeofLoadtoSizeOn="VentilationRequirement",
    DataFieldSetType="Ironbug.HVAC.IB_SizingSystem_FieldSet")
objparams_3 = IB_ObjParams(RatedCOP=number_slider_3, DataFieldSetType="Ironbug.HVAC.IB_CoilCoolingDXSingleSpeed_FieldSet")
oasystem = Ironbug_OutdoorAirSystem()
coilclndx1 = Ironbug_CoilCoolingDXSingleSpeed(Parameters_=objparams_3, dupNum=False)
coilhtngas = Ironbug_CoilHeatingGas(dupNum=False)
spm_scheduled_2 = Ironbug_SetpointManagerScheduled(Temperature="21.11", dupNum=False)
airloopbranches = AirLoopBranches(Branch1=thermalzone)
objparams_4 = IB_ObjParams(Name="DOAS", DataFieldSetType="Ironbug.HVAC.IB_AirLoopHVAC_FieldSet")
sizingsystem = Ironbug_SizingSystem(Parameters_=objparams_2, dupNum=False)

# ----
# District Cooling System
objparams_5 = IB_ObjParams(DataFieldSetType="Ironbug.HVAC.IB_FanVariableVolume_FieldSet")

fanvariable = Ironbug_FanVariableVolume(Parameters_=objparams_5, dupNum=False)
merge = Merge(Data1=oasystem, Data2=coilclndx1, Data3=coilhtngas, Data4=fanvariable, Data5=spm_scheduled_2)
airloop = Ironbug_AirLoopHVAC(Supply=merge, Demand=airloopbranches, SizingSystem=sizingsystem, Parameters_=objparams_4, dupNum=False)

hvacsystem = IB_HVACSystem(AirLoops=flatten(airloop), PlantLoops=flatten(cwloop))
detailedhvac = HBDetailedHVAC(hb_objs=flatten(roomsolid.rooms), hvac_system=hvacsystem)  # -> report, hb_objs; plug-in component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

toggle_2 = BooleanToggle(True)
solveadj = HBSolveAdjacency(rooms=flatten(detailedhvac.hb_objs), air_boundary=toggle_2, overwrite=toggle_2, run=toggle_2)  # -> report, adj_rooms; plug-in component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

# ----
# WWR
number_slider_4 = Slider(0.4, range=0..1)
aperturesbyratio = HBAperturesByRatio(hb_objs=flatten(solveadj.adj_rooms), ratio=number_slider_4, subdivide=Toggle(False))  # -> report, hb_objs; plug-in component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

model = HBModel(rooms=flatten(aperturesbyratio.hb_objs), name="Polyclinic Archetype")  # -> report, model; plug-in component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

# ----
# Run Simulation
toggle_3 = BooleanToggle(True)
modeltoosm = HBModelToOSM(model=model.model, epw_file=epw_file, sim_par=simpar, write=toggle_3, run=run)  # -> report, jsons, osw, osm, idf, sql, zsz, rdd, html; plug-in component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
eui = HBEndUseIntensity(sql=modeltoosm.sql, ip=Toggle(True))  # -> eui, eui_end_use, end_uses, gross_floor; plug-in component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

idf = ClusterOutput(modeltoosm.idf)
eui_2 = ClusterOutput(eui.eui)
eui_end_use = ClusterOutput(eui.eui_end_use)
end_uses = ClusterOutput(eui.end_uses)
gross_floor = ClusterOutput(eui.gross_floor)

# ==== cluster ClusterNursing

# ----
# Schedule
panel = Panel("""0.00
0.00
0.00
0.00
0.00
0.00
0.00
0.09
0.29
0.40
0.43
0.46
0.48
0.42
0.50
0.52
0.38
0.28
0.20
0.00
0.00
0.00
0.00
0.00""")
panel_2 = Panel("""0.00
0.00
0.00
0.00
0.00
0.00
0.00
0.00
0.00
0.07
0.03
0.04
0.10
0.13
0.13
0.00
0.00
0.00
0.00
0.00
0.00
0.00
0.00
0.00""")
panel_3 = Panel("""0.00
0.00
0.00
0.00
0.00
0.00
0.00
0.00
0.00
0.00
0.00
0.00
0.00
0.00
0.00
0.00
0.00
0.00
0.00
0.00
0.00
0.00
0.00
0.00""")
panel_4 = Panel("""120
120
120
120
120
120
120
120
120
120
120
120
120
120
120
120
120
120
120
120
120
120
120
120""")
panel_5 = Panel("""20
20
20
20
20
20
20
20
20
20
20
20
20
20
20
20
20
20
20
20
20
20
20
20""")
panel_6 = Panel("""28
28
28
28
28
28
28
28
28
28
28
28
28
28
28
28
28
28
28
28
28
28
28
28""")
weeklyschedule = HBWeeklySchedule(
    sun=panel_3,
    mon=panel,
    tue=panel,
    wed=panel,
    thu=panel,
    fri=panel,
    sat=panel_2,
    name="Building Occupancy",
    type_limit="Fractional")  # -> report, schedule, idf_year, idf_week, idf_days; plug-in component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
constantschedule = HBConstantSchedule(values=panel_6, name="Cooling Setpoint", type_limit="Temperature")  # -> report, schedule, idf_text; plug-in component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
constantschedule_2 = HBConstantSchedule(values=panel_4, name="Activity Level", type_limit="Activity Level")  # -> report, schedule, idf_text; plug-in component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
constantschedule_3 = HBConstantSchedule(values=panel_5, name="Heating Setpoint", type_limit="Temperature")  # -> report, schedule, idf_text; plug-in component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

# ----
# Construction
number_slider = Slider(1.442, range=0..2)
opaquemat = HBOpaqueMaterial(
    name="walls",
    thickness=Slider(0.125, range=0..1),
    conductivity=Slider(0.303, range=0..1),
    density=Slider(1280, range=0..2000),
    spec_heat=Slider(840, range=0..2000))  # -> mat; plug-in component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
opaquemat_2 = HBOpaqueMaterial(
    name="exterior_floors",
    thickness=Slider(0.25, range=0..1),
    conductivity=number_slider,
    density=Slider(2240, range=0..3000),
    spec_heat=Slider(840, range=0..2000))  # -> mat; plug-in component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
opaquemat_3 = HBOpaqueMaterial(
    name="roofs",
    thickness=Slider(0.25, range=0..1),
    conductivity=Slider(0.303, range=0..1),
    density=Slider(1280, range=0..2000),
    spec_heat=Slider(840, range=0..2000))  # -> mat; plug-in component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
opaqueconstr = HBOpaqueConstruction(name="exterior_wall", materials=opaquemat)  # -> constr; plug-in component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
opaqueconstr_2 = HBOpaqueConstruction(name="exterior_roof", materials=opaquemat_3)  # -> constr; plug-in component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
opaqueconstr_3 = HBOpaqueConstruction(name="exposed_floors", materials=opaquemat_2)  # -> constr; plug-in component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
panel_7 = Panel("Double Glazing with Low Emission Coating")
exteriorsubset = HBExteriorConstructionSubset(exterior_wall=opaqueconstr, exterior_roof=opaqueconstr_2, exposed_floor=opaqueconstr_3)  # -> exterior_set; plug-in component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
windowmat = HBWindowMaterial(name=panel_7, u_factor=Slider(1.6, range=0..6), shgc=Slider(0.12, range=0..1))  # -> mat; plug-in component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
windowconstr = HBWindowConstruction(name=panel_7, materials=windowmat)  # -> constr; plug-in component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
subfacesubset = HBSubfaceSubset(window=windowconstr)  # -> subface_set; plug-in component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
constructionset = HBConstructionSet(name="NursingHome", exterior_subset=exteriorsubset, subface_subset=subfacesubset)  # -> constr_set; plug-in component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

# ----
# Building Progam
number_slider_2 = Slider(6, range=0..15)
setpoint = HBSetpoint(
    name="NursingHome Setpoint",
    heating_sch=constantschedule_3.schedule,
    cooling_sch=constantschedule.schedule,
    humid_setpt=Slider(40, range=0..100),
    dehumid_setpt=Slider(70, range=0..100))  # -> setpoint; plug-in component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
servicehotwater = HBServiceHotWater(name="NursingHome Hot Water", flow_per_area=Slider(0.094152, range=0..10), schedule=weeklyschedule.schedule)  # -> hot_water; plug-in component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
lighting = HBLighting(
    name="NursingHome Lighting",
    watts_per_area=number_slider_2,
    schedule=weeklyschedule.schedule,
    radiant_fract=Slider(0.2, range=0..6),
    visible_fract=Slider(0.7, range=0..6))  # -> lighting; plug-in component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
people = HBPeople(
    name="NursingHome People",
    ppl_per_area=Slider(0.060665, range=0..1),
    occupancy_sch=weeklyschedule.schedule,
    activity_sch=constantschedule_2.schedule,
    latent_fraction=Slider(0.3, range=0..1))  # -> people; plug-in component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
ventilation = HBVentilation(name="NursingHome Ventilation", ach=Slider(2, range=0..10), schedule=weeklyschedule.schedule)  # -> vent; plug-in component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
equipment = HBEquipment(
    name="NursingHome Equipment",
    watts_per_area=Slider(7, range=0..1000),
    schedule=weeklyschedule.schedule,
    radiant_fract=Slider(0.5, range=0..6),
    gas=Toggle(False))  # -> equip; plug-in component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
programtype = HBProgramType(
    name="NursingHome",
    people=people,
    lighting=lighting,
    electric_equip=equipment,
    hot_water=servicehotwater,
    ventilation=ventilation,
    setpoint=setpoint)  # -> program; plug-in component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

geo = ClusterInput()

# ----
# Geometry
panel_8 = Panel("NursingHome Shoebox")
roomsolid = HBRoomFromSolid(geo=flatten(geo), name=panel_8, constr_set=constructionset, program=programtype, conditioned=True)  # -> report, rooms; plug-in component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

# ----
# Chilled water loop
panel_9 = Panel("0")
objparams = IB_ObjParams(
    Coefficient1OfthePartLoadPerformanceCurve=panel_9,
    Coefficient2OfthePartLoadPerformanceCurve="0.0216",
    Coefficient3OfthePartLoadPerformanceCurve="-0.0325",
    Coefficient4OfthePartLoadPerformanceCurve="1.0095",
    DataFieldSetType="Ironbug.HVAC.IB_PumpVariableSpeed_FieldSet")
districtcooling = IB_DistrictCooling(dupNum=False)
pipeadiabatic = Ironbug_PipeAdiabatic(dupNum=False)
pumpvariable = Ironbug_PumpVariableSpeed(Parameters=objparams, dupNum=False)
plantbranches = PlantBranches(B1=districtcooling, B2=pipeadiabatic, mapBranchToLoop=False)
spm_scheduled = Ironbug_SetpointManagerScheduled(Temperature="6.7", dupNum=False)
plantbranches_2 = PlantBranches(mapBranchToLoop=False)
cwloop = Ironbug_ChilledWaterPlantLoop(Supply=[pumpvariable, plantbranches, spm_scheduled], Demand=plantbranches_2, dupNum=False)

weather_file = ClusterInput()

# ----
# Weather File (2000 - 2020)
toggle = BooleanToggle(True)
epwtoddy = LBEPWToDDY(weather_file=weather_file, monthly_cool=toggle, write=toggle)  # -> ddy_file; plug-in component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
simoutput = HBSimulationOutput(zone_energy_use=toggle, gains_and_losses=toggle, surface_energy_flow=toggle)  # -> report, sim_output; plug-in component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
sizingpar = HBSizingParameter(ddy_file=epwtoddy, filter_ddays=toggle)  # -> sizing; plug-in component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
simpar = HBSimulationParameter(output=simoutput.sim_output, timestep=6, sizing=sizingpar)  # -> sim_par; plug-in component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

epw_file = ClusterInput()
run = ClusterInput()

# ----
# DOAS
number_slider_3 = Slider(3.5, range=0..10)
thermalzone = IB_ThermalZone(_HBRooms=roomsolid.rooms, IsAirTerminalPriorToZoneEquipments=True, allowMultiAirloops=False, dupNum=False)
objparams_2 = IB_ObjParams(
    CentralHeatingMaximumSystemAirFlowRatio="1",
    TypeofLoadtoSizeOn="VentilationRequirement",
    DataFieldSetType="Ironbug.HVAC.IB_SizingSystem_FieldSet")
objparams_3 = IB_ObjParams(RatedCOP=number_slider_3, DataFieldSetType="Ironbug.HVAC.IB_CoilCoolingDXSingleSpeed_FieldSet")
oasystem = Ironbug_OutdoorAirSystem()
coilclndx1 = Ironbug_CoilCoolingDXSingleSpeed(Parameters_=objparams_3, dupNum=False)
coilhtngas = Ironbug_CoilHeatingGas(dupNum=False)
spm_scheduled_2 = Ironbug_SetpointManagerScheduled(Temperature="21.11", dupNum=False)
airloopbranches = AirLoopBranches(Branch1=thermalzone)
objparams_4 = IB_ObjParams(Name="DOAS", DataFieldSetType="Ironbug.HVAC.IB_AirLoopHVAC_FieldSet")
sizingsystem = Ironbug_SizingSystem(Parameters_=objparams_2, dupNum=False)

# ----
# District Cooling System
objparams_5 = IB_ObjParams(DataFieldSetType="Ironbug.HVAC.IB_FanVariableVolume_FieldSet")

fanvariable = Ironbug_FanVariableVolume(Parameters_=objparams_5, dupNum=False)
merge = Merge(Data1=oasystem, Data2=coilclndx1, Data3=coilhtngas, Data4=fanvariable, Data5=spm_scheduled_2)
airloop = Ironbug_AirLoopHVAC(Supply=merge, Demand=airloopbranches, SizingSystem=sizingsystem, Parameters_=objparams_4, dupNum=False)

hvacsystem = IB_HVACSystem(AirLoops=flatten(airloop), PlantLoops=flatten(cwloop))
detailedhvac = HBDetailedHVAC(hb_objs=flatten(roomsolid.rooms), hvac_system=hvacsystem)  # -> report, hb_objs; plug-in component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

toggle_2 = BooleanToggle(True)
solveadj = HBSolveAdjacency(rooms=flatten(detailedhvac.hb_objs), air_boundary=toggle_2, overwrite=toggle_2, run=toggle_2)  # -> report, adj_rooms; plug-in component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

# ----
# WWR
number_slider_4 = Slider(0.4, range=0..1)
aperturesbyratio = HBAperturesByRatio(hb_objs=flatten(solveadj.adj_rooms), ratio=number_slider_4, subdivide=Toggle(False))  # -> report, hb_objs; plug-in component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

model = HBModel(rooms=flatten(aperturesbyratio.hb_objs), name="NursingHome Archetype")  # -> report, model; plug-in component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

# ----
# Run Simulation
toggle_3 = BooleanToggle(True)
modeltoosm = HBModelToOSM(model=model.model, epw_file=epw_file, sim_par=simpar, write=toggle_3, run=run)  # -> report, jsons, osw, osm, idf, sql, zsz, rdd, html; plug-in component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
eui = HBEndUseIntensity(sql=modeltoosm.sql, ip=Toggle(False))  # -> eui, eui_end_use, end_uses, gross_floor; plug-in component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

idf = ClusterOutput(modeltoosm.idf)
eui_2 = ClusterOutput(eui.eui)
eui_end_use = ClusterOutput(eui.eui_end_use)
end_uses = ClusterOutput(eui.end_uses)
gross_floor = ClusterOutput(eui.gross_floor)

# ==== cluster EnergySimCivic

# ----
# Schedule
panel = Panel("""0.00
0.00
0.00
0.00
0.00
0.00
0.00
0.00
0.11
0.40
0.65
0.68
0.69
0.64
0.61
0.61
0.59
0.58
0.47
0.36
0.20
0.09
0.00
0.00""")
panel_2 = Panel("""0.00
0.00
0.00
0.00
0.00
0.00
0.00
0.00
0.00
0.11
0.42
0.56
0.69
0.68
0.57
0.55
0.58
0.60
0.21
0.17
0.10
0.10
0.00
0.00""")
panel_3 = Panel("""0.00
0.00
0.00
0.00
0.00
0.00
0.00
0.00
0.00
0.01
0.35
0.45
0.52
0.55
0.58
0.62
0.57
0.50
0.14
0.14
0.07
0.09
0.00
0.00""")
panel_4 = Panel("""120
120
120
120
120
120
120
120
120
120
120
120
120
120
120
120
120
120
120
120
120
120
120
120""")
panel_5 = Panel("""20
20
20
20
20
20
20
20
20
20
20
20
20
20
20
20
20
20
20
20
20
20
20
20""")
panel_6 = Panel("""26
26
26
26
26
26
26
26
26
26
26
26
26
26
26
26
26
26
26
26
26
26
26
26""")
weeklyschedule = HBWeeklySchedule(
    sun=panel_3,
    mon=panel,
    tue=panel,
    wed=panel,
    thu=panel,
    fri=panel,
    sat=panel_2,
    name="Building Occupancy",
    type_limit="Fractional")  # -> report, schedule, idf_year, idf_week, idf_days; plug-in component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
constantschedule = HBConstantSchedule(values=panel_6, name="Cooling Setpoint", type_limit="Temperature")  # -> report, schedule, idf_text; plug-in component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
constantschedule_2 = HBConstantSchedule(values=panel_4, name="Activity Level", type_limit="Activity Level")  # -> report, schedule, idf_text; plug-in component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
constantschedule_3 = HBConstantSchedule(values=panel_5, name="Heating Setpoint", type_limit="Temperature")  # -> report, schedule, idf_text; plug-in component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

# ----
# Construction
number_slider = Slider(1.442, range=0..2)
opaquemat = HBOpaqueMaterial(
    name="walls",
    thickness=Slider(0.125, range=0..1),
    conductivity=Slider(0.303, range=0..1),
    density=Slider(1280, range=0..2000),
    spec_heat=Slider(840, range=0..2000))  # -> mat; plug-in component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
opaquemat_2 = HBOpaqueMaterial(
    name="exterior_floors",
    thickness=Slider(0.25, range=0..1),
    conductivity=number_slider,
    density=Slider(2240, range=0..3000),
    spec_heat=Slider(840, range=0..2000))  # -> mat; plug-in component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
opaquemat_3 = HBOpaqueMaterial(
    name="roofs",
    thickness=Slider(0.25, range=0..1),
    conductivity=Slider(0.303, range=0..1),
    density=Slider(1280, range=0..2000),
    spec_heat=Slider(840, range=0..2000))  # -> mat; plug-in component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
opaqueconstr = HBOpaqueConstruction(name="exterior_wall", materials=opaquemat)  # -> constr; plug-in component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
opaqueconstr_2 = HBOpaqueConstruction(name="exterior_roof", materials=opaquemat_3)  # -> constr; plug-in component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
opaqueconstr_3 = HBOpaqueConstruction(name="exposed_floors", materials=opaquemat_2)  # -> constr; plug-in component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
panel_7 = Panel("Double Glazing with Low Emission Coating")
exteriorsubset = HBExteriorConstructionSubset(exterior_wall=opaqueconstr, exterior_roof=opaqueconstr_2, exposed_floor=opaqueconstr_3)  # -> exterior_set; plug-in component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
windowmat = HBWindowMaterial(name=panel_7, u_factor=Slider(1.6, range=0..6), shgc=Slider(0.12, range=0..1))  # -> mat; plug-in component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
windowconstr = HBWindowConstruction(name=panel_7, materials=windowmat)  # -> constr; plug-in component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
subfacesubset = HBSubfaceSubset(window=windowconstr)  # -> subface_set; plug-in component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
constructionset = HBConstructionSet(name="CivicCommunityCultural", exterior_subset=exteriorsubset, subface_subset=subfacesubset)  # -> constr_set; plug-in component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

# ----
# Building Progam
number_slider_2 = Slider(10, range=0..15)
setpoint = HBSetpoint(
    name="CivicCommunityCultural Setpoint",
    heating_sch=constantschedule_3.schedule,
    cooling_sch=constantschedule.schedule,
    humid_setpt=Slider(40, range=0..100),
    dehumid_setpt=Slider(70, range=0..100))  # -> setpoint; plug-in component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
servicehotwater = HBServiceHotWater(name="CivicCommunityCultural Hot Water", flow_per_area=Slider(0.07274, range=0..10), schedule=weeklyschedule.schedule)  # -> hot_water; plug-in component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
lighting = HBLighting(
    name="CivicCommunityCultural Lighting",
    watts_per_area=number_slider_2,
    schedule=weeklyschedule.schedule,
    radiant_fract=Slider(0.2, range=0..6),
    visible_fract=Slider(0.7, range=0..6))  # -> lighting; plug-in component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
people = HBPeople(
    name="CivicCommunityCultural People",
    ppl_per_area=Slider(0.01, range=0..1),
    occupancy_sch=weeklyschedule.schedule,
    activity_sch=constantschedule_2.schedule,
    latent_fraction=Slider(0.3, range=0..1))  # -> people; plug-in component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
ventilation = HBVentilation(name="CivicCommunityCultural Ventilation", ach=Slider(2, range=0..10))  # -> vent; plug-in component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
equipment = HBEquipment(
    name="CivicCommunityCultural Equipment",
    watts_per_area=Slider(8, range=0..2000),
    schedule=weeklyschedule.schedule,
    radiant_fract=Slider(0.5, range=0..6),
    gas=Toggle(False))  # -> equip; plug-in component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
programtype = HBProgramType(
    name="CivicCommunityCultural",
    people=people,
    lighting=lighting,
    electric_equip=equipment,
    hot_water=servicehotwater,
    ventilation=ventilation,
    setpoint=setpoint)  # -> program; plug-in component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

# ----
# Chilled water loop
panel_8 = Panel("0.0216")
objparams = IB_ObjParams(
    Coefficient1OfthePartLoadPerformanceCurve="0",
    Coefficient2OfthePartLoadPerformanceCurve=panel_8,
    Coefficient3OfthePartLoadPerformanceCurve="-0.0325",
    Coefficient4OfthePartLoadPerformanceCurve="1.0095",
    DataFieldSetType="Ironbug.HVAC.IB_PumpVariableSpeed_FieldSet")
districtcooling = IB_DistrictCooling(dupNum=False)
pipeadiabatic = Ironbug_PipeAdiabatic(dupNum=False)
pumpvariable = Ironbug_PumpVariableSpeed(Parameters=objparams, dupNum=False)
plantbranches = PlantBranches(B1=districtcooling, B2=pipeadiabatic, mapBranchToLoop=False)
spm_scheduled = Ironbug_SetpointManagerScheduled(Temperature="6.7", dupNum=False)
plantbranches_2 = PlantBranches(mapBranchToLoop=False)
cwloop = Ironbug_ChilledWaterPlantLoop(Supply=[pumpvariable, plantbranches, spm_scheduled], Demand=plantbranches_2, dupNum=False)

geo = ClusterInput()

# ----
# Geometry
panel_9 = Panel("CivicCommunityCultural Shoebox")
roomsolid = HBRoomFromSolid(geo=flatten(geo), name=panel_9, constr_set=constructionset, program=programtype, conditioned=True)  # -> report, rooms; plug-in component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

weather_file = ClusterInput()

# ----
# Weather File (2000 - 2020)
toggle = BooleanToggle(True)
simoutput = HBSimulationOutput(zone_energy_use=toggle, gains_and_losses=toggle, surface_energy_flow=toggle)  # -> report, sim_output; plug-in component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
epwtoddy = LBEPWToDDY(weather_file=weather_file, monthly_cool=toggle, write=toggle)  # -> ddy_file; plug-in component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
sizingpar = HBSizingParameter(ddy_file=epwtoddy, filter_ddays=toggle)  # -> sizing; plug-in component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
simpar = HBSimulationParameter(output=simoutput.sim_output, timestep=6, sizing=sizingpar)  # -> sim_par; plug-in component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

epw_file = ClusterInput()
run = ClusterInput()

# ----
# DOAS
number_slider_3 = Slider(3.5, range=0..10)
thermalzone = IB_ThermalZone(_HBRooms=roomsolid.rooms, IsAirTerminalPriorToZoneEquipments=True, allowMultiAirloops=False, dupNum=False)
objparams_2 = IB_ObjParams(
    CentralHeatingMaximumSystemAirFlowRatio="1",
    TypeofLoadtoSizeOn="VentilationRequirement",
    DataFieldSetType="Ironbug.HVAC.IB_SizingSystem_FieldSet")
objparams_3 = IB_ObjParams(RatedCOP=number_slider_3, DataFieldSetType="Ironbug.HVAC.IB_CoilCoolingDXSingleSpeed_FieldSet")
oasystem = Ironbug_OutdoorAirSystem()
coilclndx1 = Ironbug_CoilCoolingDXSingleSpeed(Parameters_=objparams_3, dupNum=False)
coilhtngas = Ironbug_CoilHeatingGas(dupNum=False)
spm_scheduled_2 = Ironbug_SetpointManagerScheduled(Temperature="21.11", dupNum=False)
airloopbranches = AirLoopBranches(Branch1=thermalzone)
objparams_4 = IB_ObjParams(Name="DOAS", DataFieldSetType="Ironbug.HVAC.IB_AirLoopHVAC_FieldSet")
sizingsystem = Ironbug_SizingSystem(Parameters_=objparams_2, dupNum=False)

# ----
# District Cooling System
objparams_5 = IB_ObjParams(DataFieldSetType="Ironbug.HVAC.IB_FanVariableVolume_FieldSet")

fanvariable = Ironbug_FanVariableVolume(Parameters_=objparams_5, dupNum=False)
merge = Merge(Data1=oasystem, Data2=coilclndx1, Data3=coilhtngas, Data4=fanvariable, Data5=spm_scheduled_2)
airloop = Ironbug_AirLoopHVAC(Supply=merge, Demand=airloopbranches, SizingSystem=sizingsystem, Parameters_=objparams_4, dupNum=False)

hvacsystem = IB_HVACSystem(AirLoops=flatten(airloop), PlantLoops=flatten(cwloop))
detailedhvac = HBDetailedHVAC(hb_objs=flatten(roomsolid.rooms), hvac_system=hvacsystem)  # -> report, hb_objs; plug-in component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

toggle_2 = BooleanToggle(True)
solveadj = HBSolveAdjacency(rooms=flatten(detailedhvac.hb_objs), air_boundary=toggle_2, overwrite=toggle_2, run=toggle_2)  # -> report, adj_rooms; plug-in component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

# ----
# WWR
number_slider_4 = Slider(0.4, range=0..1)
aperturesbyratio = HBAperturesByRatio(hb_objs=flatten(solveadj.adj_rooms), ratio=number_slider_4, subdivide=Toggle(False))  # -> report, hb_objs; plug-in component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

model = HBModel(rooms=flatten(aperturesbyratio.hb_objs), name="CivicCommunityCultural Archetype")  # -> report, model; plug-in component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

# ----
# Run Simulation
toggle_3 = BooleanToggle(True)

modeltoosm = HBModelToOSM(model=model.model, epw_file=epw_file, sim_par=simpar, write=toggle_3, run=run)  # -> report, jsons, osw, osm, idf, sql, zsz, rdd, html; plug-in component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
idf = ClusterOutput(modeltoosm.idf)

eui = HBEndUseIntensity(sql=modeltoosm.sql, ip=Toggle(True))  # -> eui, eui_end_use, end_uses, gross_floor; plug-in component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

eui_2 = ClusterOutput(eui.eui)
eui_end_use = ClusterOutput(eui.eui_end_use)
end_uses = ClusterOutput(eui.end_uses)
gross_floor = ClusterOutput(eui.gross_floor)

# ==== cluster EnergySimSports

# ----
# Schedule
panel = Panel("""0.00
0.00
0.00
0.00
0.00
0.00
0.00
0.00
0.26
0.35
0.41
0.45
0.45
0.46
0.45
0.47
0.49
0.57
0.65
0.66
0.57
0.40
0.00
0.00""")
panel_2 = Panel("""0.00
0.00
0.00
0.00
0.00
0.00
0.00
0.10
0.33
0.49
0.62
0.66
0.66
0.65
0.62
0.57
0.57
0.61
0.70
0.77
0.70
0.58
0.00
0.00""")
panel_3 = Panel("""0.00
0.00
0.00
0.00
0.00
0.00
0.00
0.00
0.28
0.40
0.55
0.69
0.65
0.61
0.60
0.60
0.66
0.72
0.73
0.66
0.54
0.35
0.00
0.00""")
panel_4 = Panel("""120
120
120
120
120
120
120
120
120
120
120
120
120
120
120
120
120
120
120
120
120
120
120
120""")
panel_5 = Panel("""20
20
20
20
20
20
20
20
20
20
20
20
20
20
20
20
20
20
20
20
20
20
20
20""")
panel_6 = Panel("""26
26
26
26
26
26
26
26
26
26
26
26
26
26
26
26
26
26
26
26
26
26
26
26""")
weeklyschedule = HBWeeklySchedule(
    sun=panel_3,
    mon=panel,
    tue=panel,
    wed=panel,
    thu=panel,
    fri=panel,
    sat=panel_2,
    name="Building Occupancy",
    type_limit="Fractional")  # -> report, schedule, idf_year, idf_week, idf_days; plug-in component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
constantschedule = HBConstantSchedule(values=panel_6, name="Cooling Setpoint", type_limit="Temperature")  # -> report, schedule, idf_text; plug-in component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
constantschedule_2 = HBConstantSchedule(values=panel_4, name="Activity Level", type_limit="Activity Level")  # -> report, schedule, idf_text; plug-in component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
constantschedule_3 = HBConstantSchedule(values=panel_5, name="Heating Setpoint", type_limit="Temperature")  # -> report, schedule, idf_text; plug-in component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

# ----
# Construction
number_slider = Slider(1.442, range=0..2)
opaquemat = HBOpaqueMaterial(
    name="walls",
    thickness=Slider(0.125, range=0..1),
    conductivity=Slider(0.303, range=0..1),
    density=Slider(1280, range=0..2000),
    spec_heat=Slider(840, range=0..2000))  # -> mat; plug-in component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
opaquemat_2 = HBOpaqueMaterial(
    name="exterior_floors",
    thickness=Slider(0.25, range=0..1),
    conductivity=number_slider,
    density=Slider(2240, range=0..3000),
    spec_heat=Slider(840, range=0..2000))  # -> mat; plug-in component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
opaquemat_3 = HBOpaqueMaterial(
    name="roofs",
    thickness=Slider(0.25, range=0..1),
    conductivity=Slider(0.303, range=0..1),
    density=Slider(1280, range=0..2000),
    spec_heat=Slider(840, range=0..2000))  # -> mat; plug-in component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
opaqueconstr = HBOpaqueConstruction(name="exterior_wall", materials=opaquemat)  # -> constr; plug-in component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
opaqueconstr_2 = HBOpaqueConstruction(name="exterior_roof", materials=opaquemat_3)  # -> constr; plug-in component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
opaqueconstr_3 = HBOpaqueConstruction(name="exposed_floors", materials=opaquemat_2)  # -> constr; plug-in component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
panel_7 = Panel("Double Glazing with Low Emission Coating")
exteriorsubset = HBExteriorConstructionSubset(exterior_wall=opaqueconstr, exterior_roof=opaqueconstr_2, exposed_floor=opaqueconstr_3)  # -> exterior_set; plug-in component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
windowmat = HBWindowMaterial(name=panel_7, u_factor=Slider(1.6, range=0..6), shgc=Slider(0.12, range=0..1))  # -> mat; plug-in component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
windowconstr = HBWindowConstruction(name=panel_7, materials=windowmat)  # -> constr; plug-in component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
subfacesubset = HBSubfaceSubset(window=windowconstr)  # -> subface_set; plug-in component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
constructionset = HBConstructionSet(name="Sports&Rec", exterior_subset=exteriorsubset, subface_subset=subfacesubset)  # -> constr_set; plug-in component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

# ----
# Building Progam
number_slider_2 = Slider(10, range=0..15)
setpoint = HBSetpoint(
    name="Sports&Rec Setpoint",
    heating_sch=constantschedule_3.schedule,
    cooling_sch=constantschedule.schedule,
    humid_setpt=Slider(40, range=0..100),
    dehumid_setpt=Slider(60, range=0..100))  # -> setpoint; plug-in component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
servicehotwater = HBServiceHotWater(name="Sports&Rec Hot Water", flow_per_area=Slider(0.14548, range=0..10), schedule=weeklyschedule.schedule)  # -> hot_water; plug-in component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
lighting = HBLighting(
    name="Sports&Rec Lighting",
    watts_per_area=number_slider_2,
    schedule=weeklyschedule.schedule,
    radiant_fract=Slider(0.2, range=0..6),
    visible_fract=Slider(0.7, range=0..6))  # -> lighting; plug-in component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
people = HBPeople(
    name="Sports&Rec People",
    ppl_per_area=Slider(0.2, range=0..1),
    occupancy_sch=weeklyschedule.schedule,
    activity_sch=constantschedule_2.schedule,
    latent_fraction=Slider(0.3, range=0..1))  # -> people; plug-in component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
ventilation = HBVentilation(name="Sports&Rec Ventilation", ach=Slider(2.5, range=0..10))  # -> vent; plug-in component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
equipment = HBEquipment(
    name="Sports&Rec Equipment",
    watts_per_area=Slider(5, range=0..2000),
    schedule=weeklyschedule.schedule,
    radiant_fract=Slider(0.5, range=0..6),
    gas=Toggle(False))  # -> equip; plug-in component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
programtype = HBProgramType(
    name="Sports&Rec",
    people=people,
    lighting=lighting,
    electric_equip=equipment,
    hot_water=servicehotwater,
    ventilation=ventilation,
    setpoint=setpoint)  # -> program; plug-in component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

geo = ClusterInput()

# ----
# Geometry
panel_8 = Panel("Sports&Rec Shoebox")
roomsolid = HBRoomFromSolid(geo=flatten(geo), name=panel_8, constr_set=constructionset, program=programtype, conditioned=True)  # -> report, rooms; plug-in component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

# ----
# Chilled water loop
panel_9 = Panel("0.0216")
objparams = IB_ObjParams(
    Coefficient1OfthePartLoadPerformanceCurve="0",
    Coefficient2OfthePartLoadPerformanceCurve=panel_9,
    Coefficient3OfthePartLoadPerformanceCurve="-0.0325",
    Coefficient4OfthePartLoadPerformanceCurve="1.0095",
    DataFieldSetType="Ironbug.HVAC.IB_PumpVariableSpeed_FieldSet")
districtcooling = IB_DistrictCooling(dupNum=False)
pipeadiabatic = Ironbug_PipeAdiabatic(dupNum=False)
pumpvariable = Ironbug_PumpVariableSpeed(Parameters=objparams, dupNum=False)
plantbranches = PlantBranches(B1=districtcooling, B2=pipeadiabatic, mapBranchToLoop=False)
spm_scheduled = Ironbug_SetpointManagerScheduled(Temperature="6.7", dupNum=False)
plantbranches_2 = PlantBranches(mapBranchToLoop=False)
cwloop = Ironbug_ChilledWaterPlantLoop(Supply=[pumpvariable, plantbranches, spm_scheduled], Demand=plantbranches_2, dupNum=False)

weather_file = ClusterInput()

# ----
# Weather File (2000 - 2020)
toggle = BooleanToggle(True)
epwtoddy = LBEPWToDDY(weather_file=weather_file, monthly_cool=toggle, write=toggle)  # -> ddy_file; plug-in component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
simoutput = HBSimulationOutput(zone_energy_use=toggle, gains_and_losses=toggle, surface_energy_flow=toggle)  # -> report, sim_output; plug-in component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
sizingpar = HBSizingParameter(ddy_file=epwtoddy, filter_ddays=toggle)  # -> sizing; plug-in component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
simpar = HBSimulationParameter(output=simoutput.sim_output, timestep=6, sizing=sizingpar)  # -> sim_par; plug-in component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

epw_file = ClusterInput()
run = ClusterInput()

# ----
# DOAS
number_slider_3 = Slider(3.5, range=0..10)
thermalzone = IB_ThermalZone(_HBRooms=roomsolid.rooms, IsAirTerminalPriorToZoneEquipments=True, allowMultiAirloops=False, dupNum=False)
objparams_2 = IB_ObjParams(
    CentralHeatingMaximumSystemAirFlowRatio="1",
    TypeofLoadtoSizeOn="VentilationRequirement",
    DataFieldSetType="Ironbug.HVAC.IB_SizingSystem_FieldSet")
objparams_3 = IB_ObjParams(RatedCOP=number_slider_3, DataFieldSetType="Ironbug.HVAC.IB_CoilCoolingDXSingleSpeed_FieldSet")
oasystem = Ironbug_OutdoorAirSystem()
coilclndx1 = Ironbug_CoilCoolingDXSingleSpeed(Parameters_=objparams_3, dupNum=False)
coilhtngas = Ironbug_CoilHeatingGas(dupNum=False)
spm_scheduled_2 = Ironbug_SetpointManagerScheduled(Temperature="21.11", dupNum=False)
airloopbranches = AirLoopBranches(Branch1=thermalzone)
objparams_4 = IB_ObjParams(Name="DOAS", DataFieldSetType="Ironbug.HVAC.IB_AirLoopHVAC_FieldSet")
sizingsystem = Ironbug_SizingSystem(Parameters_=objparams_2, dupNum=False)

# ----
# District Cooling System
objparams_5 = IB_ObjParams(DataFieldSetType="Ironbug.HVAC.IB_FanVariableVolume_FieldSet")

fanvariable = Ironbug_FanVariableVolume(Parameters_=objparams_5, dupNum=False)
merge = Merge(Data1=oasystem, Data2=coilclndx1, Data3=coilhtngas, Data4=fanvariable, Data5=spm_scheduled_2)
airloop = Ironbug_AirLoopHVAC(Supply=merge, Demand=airloopbranches, SizingSystem=sizingsystem, Parameters_=objparams_4, dupNum=False)

hvacsystem = IB_HVACSystem(AirLoops=flatten(airloop), PlantLoops=flatten(cwloop))
detailedhvac = HBDetailedHVAC(hb_objs=flatten(roomsolid.rooms), hvac_system=hvacsystem)  # -> report, hb_objs; plug-in component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

toggle_2 = BooleanToggle(True)
solveadj = HBSolveAdjacency(rooms=flatten(detailedhvac.hb_objs), air_boundary=toggle_2, overwrite=toggle_2, run=toggle_2)  # -> report, adj_rooms; plug-in component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

# ----
# WWR
number_slider_4 = Slider(0.4, range=0..1)
aperturesbyratio = HBAperturesByRatio(hb_objs=flatten(solveadj.adj_rooms), ratio=number_slider_4, subdivide=Toggle(False))  # -> report, hb_objs; plug-in component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

model = HBModel(rooms=flatten(aperturesbyratio.hb_objs), name="Sports&Rec Archetype")  # -> report, model; plug-in component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

# ----
# Run Simulation
toggle_3 = BooleanToggle(True)
modeltoosm = HBModelToOSM(model=model.model, epw_file=epw_file, sim_par=simpar, write=toggle_3, run=run)  # -> report, jsons, osw, osm, idf, sql, zsz, rdd, html; plug-in component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
eui = HBEndUseIntensity(sql=modeltoosm.sql, ip=Toggle(False))  # -> eui, eui_end_use, end_uses, gross_floor; plug-in component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

idf = ClusterOutput(modeltoosm.idf)
eui_2 = ClusterOutput(eui.eui)
eui_end_use = ClusterOutput(eui.eui_end_use)
end_uses = ClusterOutput(eui.end_uses)
gross_floor = ClusterOutput(eui.gross_floor)

# ==== cluster EnergySimRestaurant

# ----
# Schedule
panel = Panel("""0.13
0.09
0.04
0.03
0.02
0.02
0.05
0.02
0.12
0.15
0.21
0.23
0.34
0.36
0.34
0.30
0.29
0.34
0.40
0.46
0.48
0.55
0.54
0.30""")
panel_2 = Panel("""0.28
0.20
0.11
0.07
0.05
0.07
0.10
0.15
0.30
0.23
0.23
0.33
0.43
0.41
0.41
0.30
0.39
0.52
0.58
0.65
0.70
0.58
0.54
0.46""")
panel_3 = Panel("""0.29
0.21
0.12
0.06
0.04
0.01
0.03
0.09
0.20
0.28
0.17
0.24
0.41
0.42
0.43
0.44
0.42
0.43
0.49
0.55
0.51
0.49
0.39
0.30""")
panel_4 = Panel("""120
120
120
120
120
120
120
120
120
120
120
120
120
120
120
120
120
120
120
120
120
120
120
120""")
panel_5 = Panel("""20
20
20
20
20
20
20
20
20
20
20
20
20
20
20
20
20
20
20
20
20
20
20
20""")
panel_6 = Panel("""28
28
28
28
28
28
28
28
28
28
28
28
28
28
28
28
28
28
28
28
28
28
28
28""")
weeklyschedule = HBWeeklySchedule(
    sun=panel_3,
    mon=panel,
    tue=panel,
    wed=panel,
    thu=panel,
    fri=panel,
    sat=panel_2,
    name="Building Occupancy",
    type_limit="Fractional")  # -> report, schedule, idf_year, idf_week, idf_days; plug-in component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
constantschedule = HBConstantSchedule(values=panel_6, name="Cooling Setpoint", type_limit="Temperature")  # -> report, schedule, idf_text; plug-in component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
constantschedule_2 = HBConstantSchedule(values=panel_4, name="Activity Level", type_limit="Activity Level")  # -> report, schedule, idf_text; plug-in component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
constantschedule_3 = HBConstantSchedule(values=panel_5, name="Heating Setpoint", type_limit="Temperature")  # -> report, schedule, idf_text; plug-in component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

# ----
# Construction
number_slider = Slider(1.442, range=0..2)
opaquemat = HBOpaqueMaterial(
    name="walls",
    thickness=Slider(0.125, range=0..1),
    conductivity=Slider(0.303, range=0..1),
    density=Slider(1280, range=0..2000),
    spec_heat=Slider(840, range=0..2000))  # -> mat; plug-in component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
opaquemat_2 = HBOpaqueMaterial(
    name="exterior_floors",
    thickness=Slider(0.25, range=0..1),
    conductivity=number_slider,
    density=Slider(2240, range=0..3000),
    spec_heat=Slider(840, range=0..2000))  # -> mat; plug-in component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
opaquemat_3 = HBOpaqueMaterial(
    name="roofs",
    thickness=Slider(0.25, range=0..1),
    conductivity=Slider(0.303, range=0..1),
    density=Slider(1280, range=0..2000),
    spec_heat=Slider(840, range=0..2000))  # -> mat; plug-in component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
opaqueconstr = HBOpaqueConstruction(name="exterior_wall", materials=opaquemat)  # -> constr; plug-in component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
opaqueconstr_2 = HBOpaqueConstruction(name="exterior_roof", materials=opaquemat_3)  # -> constr; plug-in component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
opaqueconstr_3 = HBOpaqueConstruction(name="exposed_floors", materials=opaquemat_2)  # -> constr; plug-in component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
panel_7 = Panel("Double Glazing with Low Emission Coating")
exteriorsubset = HBExteriorConstructionSubset(exterior_wall=opaqueconstr, exterior_roof=opaqueconstr_2, exposed_floor=opaqueconstr_3)  # -> exterior_set; plug-in component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
windowmat = HBWindowMaterial(name=panel_7, u_factor=Slider(1.6, range=0..6), shgc=Slider(0.12, range=0..1))  # -> mat; plug-in component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
windowconstr = HBWindowConstruction(name=panel_7, materials=windowmat)  # -> constr; plug-in component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
subfacesubset = HBSubfaceSubset(window=windowconstr)  # -> subface_set; plug-in component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
constructionset = HBConstructionSet(name="Restaurant", exterior_subset=exteriorsubset, subface_subset=subfacesubset)  # -> constr_set; plug-in component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

# ----
# Building Progam
number_slider_2 = Slider(12, range=0..15)
setpoint = HBSetpoint(
    name="Restaurant Setpoint",
    heating_sch=constantschedule_3.schedule,
    cooling_sch=constantschedule.schedule,
    humid_setpt=Slider(40, range=0..100),
    dehumid_setpt=Slider(70, range=0..100))  # -> setpoint; plug-in component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
servicehotwater = HBServiceHotWater(name="Restaurant Hot Water", flow_per_area=Slider(0.48493, range=0..10), schedule=weeklyschedule.schedule)  # -> hot_water; plug-in component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
lighting = HBLighting(
    name="Restaurant Lighting",
    watts_per_area=number_slider_2,
    schedule=weeklyschedule.schedule,
    radiant_fract=Slider(0.2, range=0..6),
    visible_fract=Slider(0.7, range=0..6))  # -> lighting; plug-in component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
people = HBPeople(
    name="Restaurant People",
    ppl_per_area=Slider(0.666667, range=0..1),
    occupancy_sch=weeklyschedule.schedule,
    activity_sch=constantschedule_2.schedule,
    latent_fraction=Slider(0.3, range=0..1))  # -> people; plug-in component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
ventilation = HBVentilation(name="Restaurant Ventilation", ach=Slider(2, range=0..10))  # -> vent; plug-in component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
equipment = HBEquipment(
    name="Restaurant Equipment",
    watts_per_area=Slider(10, range=0..2000),
    schedule=weeklyschedule.schedule,
    radiant_fract=Slider(0.5, range=0..6),
    gas=Toggle(False))  # -> equip; plug-in component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
programtype = HBProgramType(
    name="Restaurant",
    people=people,
    lighting=lighting,
    electric_equip=equipment,
    hot_water=servicehotwater,
    ventilation=ventilation,
    setpoint=setpoint)  # -> program; plug-in component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

geo = ClusterInput()

# ----
# Geometry
panel_8 = Panel("Restaurant Shoebox")
roomsolid = HBRoomFromSolid(geo=flatten(geo), name=panel_8, constr_set=constructionset, program=programtype, conditioned=True)  # -> report, rooms; plug-in component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

# ----
# Chilled water loop
panel_9 = Panel("0")
objparams = IB_ObjParams(
    Coefficient1OfthePartLoadPerformanceCurve=panel_9,
    Coefficient2OfthePartLoadPerformanceCurve="0.0216",
    Coefficient3OfthePartLoadPerformanceCurve="-0.0325",
    Coefficient4OfthePartLoadPerformanceCurve="1.0095",
    DataFieldSetType="Ironbug.HVAC.IB_PumpVariableSpeed_FieldSet")
districtcooling = IB_DistrictCooling(dupNum=False)
pipeadiabatic = Ironbug_PipeAdiabatic(dupNum=False)
pumpvariable = Ironbug_PumpVariableSpeed(Parameters=objparams, dupNum=False)
plantbranches = PlantBranches(B1=districtcooling, B2=pipeadiabatic, mapBranchToLoop=False)
spm_scheduled = Ironbug_SetpointManagerScheduled(Temperature="6.7", dupNum=False)
plantbranches_2 = PlantBranches(mapBranchToLoop=False)
cwloop = Ironbug_ChilledWaterPlantLoop(Supply=[pumpvariable, plantbranches, spm_scheduled], Demand=plantbranches_2, dupNum=False)

weather_file = ClusterInput()

# ----
# Weather File (2000 - 2020)
toggle = BooleanToggle(True)
simoutput = HBSimulationOutput(zone_energy_use=toggle, gains_and_losses=toggle, surface_energy_flow=toggle)  # -> report, sim_output; plug-in component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
epwtoddy = LBEPWToDDY(weather_file=weather_file, monthly_cool=toggle, write=toggle)  # -> ddy_file; plug-in component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
sizingpar = HBSizingParameter(ddy_file=epwtoddy, filter_ddays=toggle)  # -> sizing; plug-in component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
simpar = HBSimulationParameter(output=simoutput.sim_output, timestep=6, sizing=sizingpar)  # -> sim_par; plug-in component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

epw_file = ClusterInput()
run = ClusterInput()

# ----
# DOAS
number_slider_3 = Slider(1.5, range=0..10)
thermalzone = IB_ThermalZone(_HBRooms=roomsolid.rooms, IsAirTerminalPriorToZoneEquipments=True, allowMultiAirloops=False, dupNum=False)
objparams_2 = IB_ObjParams(
    CentralHeatingMaximumSystemAirFlowRatio="1",
    TypeofLoadtoSizeOn="VentilationRequirement",
    DataFieldSetType="Ironbug.HVAC.IB_SizingSystem_FieldSet")
objparams_3 = IB_ObjParams(RatedCOP=number_slider_3, DataFieldSetType="Ironbug.HVAC.IB_CoilCoolingDXSingleSpeed_FieldSet")
oasystem = Ironbug_OutdoorAirSystem()
coilclndx1 = Ironbug_CoilCoolingDXSingleSpeed(Parameters_=objparams_3, dupNum=False)
coilhtngas = Ironbug_CoilHeatingGas(dupNum=False)
spm_scheduled_2 = Ironbug_SetpointManagerScheduled(Temperature="21.11", dupNum=False)
airloopbranches = AirLoopBranches(Branch1=thermalzone)
objparams_4 = IB_ObjParams(Name="DOAS", DataFieldSetType="Ironbug.HVAC.IB_AirLoopHVAC_FieldSet")
sizingsystem = Ironbug_SizingSystem(Parameters_=objparams_2, dupNum=False)

# ----
# District Cooling System
objparams_5 = IB_ObjParams(DataFieldSetType="Ironbug.HVAC.IB_FanVariableVolume_FieldSet")

fanvariable = Ironbug_FanVariableVolume(Parameters_=objparams_5, dupNum=False)
merge = Merge(Data1=oasystem, Data2=coilclndx1, Data3=coilhtngas, Data4=fanvariable, Data5=spm_scheduled_2)
airloop = Ironbug_AirLoopHVAC(Supply=merge, Demand=airloopbranches, SizingSystem=sizingsystem, Parameters_=objparams_4, dupNum=False)

hvacsystem = IB_HVACSystem(AirLoops=flatten(airloop), PlantLoops=flatten(cwloop))
detailedhvac = HBDetailedHVAC(hb_objs=flatten(roomsolid.rooms), hvac_system=hvacsystem)  # -> report, hb_objs; plug-in component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

toggle_2 = BooleanToggle(True)
solveadj = HBSolveAdjacency(rooms=flatten(detailedhvac.hb_objs), air_boundary=toggle_2, overwrite=toggle_2, run=toggle_2)  # -> report, adj_rooms; plug-in component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

# ----
# WWR
number_slider_4 = Slider(0.4, range=0..1)
aperturesbyratio = HBAperturesByRatio(hb_objs=flatten(solveadj.adj_rooms), ratio=number_slider_4, subdivide=Toggle(False))  # -> report, hb_objs; plug-in component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

model = HBModel(rooms=flatten(aperturesbyratio.hb_objs), name="Restaurant Archetype")  # -> report, model; plug-in component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

# ----
# Run Simulation
toggle_3 = BooleanToggle(True)
modeltoosm = HBModelToOSM(model=model.model, epw_file=epw_file, sim_par=simpar, write=toggle_3, run=run)  # -> report, jsons, osw, osm, idf, sql, zsz, rdd, html; plug-in component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
eui = HBEndUseIntensity(sql=modeltoosm.sql, ip=Toggle(False))  # -> eui, eui_end_use, end_uses, gross_floor; plug-in component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

idf = ClusterOutput(modeltoosm.idf)
eui_2 = ClusterOutput(eui.eui)
eui_end_use = ClusterOutput(eui.eui_end_use)
end_uses = ClusterOutput(eui.end_uses)
gross_floor = ClusterOutput(eui.gross_floor)

# ==== cluster EnergySimSupermarket

# ----
# Schedule
panel = Panel("""0.16
0.10
0.05
0.04
0.05
0.10
0.20
0.32
0.40
0.51
0.55
0.60
0.61
0.59
0.56
0.55
0.57
0.62
0.66
0.65
0.59
0.48
0.38
0.27""")
panel_2 = Panel("""0.24
0.15
0.09
0.06
0.03
0.04
0.09
0.18
0.42
0.61
0.74
0.74
0.82
0.87
0.83
0.76
0.69
0.72
0.73
0.74
0.66
0.54
0.44
0.28""")
panel_3 = Panel("""0.25
0.12
0.07
0.05
0.08
0.12
0.22
0.38
0.51
0.59
0.77
0.71
0.74
0.79
0.82
0.81
0.75
0.68
0.70
0.70
0.63
0.56
0.44
0.30""")
panel_4 = Panel("""120
120
120
120
120
120
120
120
120
120
120
120
120
120
120
120
120
120
120
120
120
120
120
120""")
panel_5 = Panel("""20
20
20
20
20
20
20
20
20
20
20
20
20
20
20
20
20
20
20
20
20
20
20
20""")
panel_6 = Panel("""26
26
26
26
26
26
26
26
26
26
26
26
26
26
26
26
26
26
26
26
26
26
26
26""")
weeklyschedule = HBWeeklySchedule(
    sun=panel_2,
    mon=panel,
    tue=panel,
    wed=panel,
    thu=panel,
    fri=panel,
    sat=panel_3,
    name="Building Occupancy",
    type_limit="Fractional")  # -> report, schedule, idf_year, idf_week, idf_days; plug-in component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
constantschedule = HBConstantSchedule(values=panel_6, name="Cooling Setpoint", type_limit="Temperature")  # -> report, schedule, idf_text; plug-in component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
constantschedule_2 = HBConstantSchedule(values=panel_4, name="Activity Level", type_limit="Activity Level")  # -> report, schedule, idf_text; plug-in component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
constantschedule_3 = HBConstantSchedule(values=panel_5, name="Heating Setpoint", type_limit="Temperature")  # -> report, schedule, idf_text; plug-in component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

# ----
# Construction
number_slider = Slider(1.442, range=0..2)
opaquemat = HBOpaqueMaterial(
    name="walls",
    thickness=Slider(0.125, range=0..1),
    conductivity=Slider(0.303, range=0..1),
    density=Slider(1280, range=0..2000),
    spec_heat=Slider(840, range=0..2000))  # -> mat; plug-in component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
opaquemat_2 = HBOpaqueMaterial(
    name="exterior_floors",
    thickness=Slider(0.25, range=0..1),
    conductivity=number_slider,
    density=Slider(2240, range=0..3000),
    spec_heat=Slider(840, range=0..2000))  # -> mat; plug-in component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
opaquemat_3 = HBOpaqueMaterial(
    name="roofs",
    thickness=Slider(0.25, range=0..1),
    conductivity=Slider(0.303, range=0..1),
    density=Slider(1280, range=0..2000),
    spec_heat=Slider(840, range=0..2000))  # -> mat; plug-in component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
opaqueconstr = HBOpaqueConstruction(name="exterior_wall", materials=opaquemat)  # -> constr; plug-in component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
opaqueconstr_2 = HBOpaqueConstruction(name="exterior_roof", materials=opaquemat_3)  # -> constr; plug-in component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
opaqueconstr_3 = HBOpaqueConstruction(name="exposed_floors", materials=opaquemat_2)  # -> constr; plug-in component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
panel_7 = Panel("Double Glazing with Low Emission Coating")
exteriorsubset = HBExteriorConstructionSubset(exterior_wall=opaqueconstr, exterior_roof=opaqueconstr_2, exposed_floor=opaqueconstr_3)  # -> exterior_set; plug-in component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
windowmat = HBWindowMaterial(name=panel_7, u_factor=Slider(1.6, range=0..6), shgc=Slider(0.12, range=0..1))  # -> mat; plug-in component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
windowconstr = HBWindowConstruction(name=panel_7, materials=windowmat)  # -> constr; plug-in component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
subfacesubset = HBSubfaceSubset(window=windowconstr)  # -> subface_set; plug-in component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
constructionset = HBConstructionSet(name="Supermarket", exterior_subset=exteriorsubset, subface_subset=subfacesubset)  # -> constr_set; plug-in component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

# ----
# Building Progam
number_slider_2 = Slider(20, range=0..20)
setpoint = HBSetpoint(
    name="Supermarket Setpoint",
    heating_sch=constantschedule_3.schedule,
    cooling_sch=constantschedule.schedule,
    humid_setpt=Slider(40, range=0..100),
    dehumid_setpt=Slider(70, range=0..100))  # -> setpoint; plug-in component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
servicehotwater = HBServiceHotWater(name="Supermarket Hot Water", flow_per_area=Slider(0.14548, range=0..10), schedule=weeklyschedule.schedule)  # -> hot_water; plug-in component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
lighting = HBLighting(
    name="Supermarket Lighting",
    watts_per_area=number_slider_2,
    schedule=weeklyschedule.schedule,
    radiant_fract=Slider(0.2, range=0..6),
    visible_fract=Slider(0.7, range=0..6))  # -> lighting; plug-in component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
people = HBPeople(
    name="Supermarket People",
    ppl_per_area=Slider(0.2, range=0..1),
    occupancy_sch=weeklyschedule.schedule,
    activity_sch=constantschedule_2.schedule,
    latent_fraction=Slider(0.3, range=0..1))  # -> people; plug-in component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
ventilation = HBVentilation(name="Supermarket Ventilation", ach=Slider(10, range=0..10))  # -> vent; plug-in component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
equipment = HBEquipment(
    name="Supermarket Equipment",
    watts_per_area=Slider(50, range=0..2000),
    schedule=weeklyschedule.schedule,
    radiant_fract=Slider(0.5, range=0..6),
    gas=Toggle(False))  # -> equip; plug-in component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
programtype = HBProgramType(
    name="Supermarket",
    people=people,
    lighting=lighting,
    electric_equip=equipment,
    hot_water=servicehotwater,
    ventilation=ventilation,
    setpoint=setpoint)  # -> program; plug-in component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

# ----
# Chilled water loop
panel_8 = Panel("0")
objparams = IB_ObjParams(
    Coefficient1OfthePartLoadPerformanceCurve=panel_8,
    Coefficient2OfthePartLoadPerformanceCurve="0.0216",
    Coefficient3OfthePartLoadPerformanceCurve="-0.0325",
    Coefficient4OfthePartLoadPerformanceCurve="1.0095",
    DataFieldSetType="Ironbug.HVAC.IB_PumpVariableSpeed_FieldSet")
districtcooling = IB_DistrictCooling(dupNum=False)
pipeadiabatic = Ironbug_PipeAdiabatic(dupNum=False)
pumpvariable = Ironbug_PumpVariableSpeed(Parameters=objparams, dupNum=False)
plantbranches = PlantBranches(B1=districtcooling, B2=pipeadiabatic, mapBranchToLoop=False)
spm_scheduled = Ironbug_SetpointManagerScheduled(Temperature="6.7", dupNum=False)
plantbranches_2 = PlantBranches(mapBranchToLoop=False)
cwloop = Ironbug_ChilledWaterPlantLoop(Supply=[pumpvariable, plantbranches, spm_scheduled], Demand=plantbranches_2, dupNum=False)

geo = ClusterInput()

# ----
# Geometry
panel_9 = Panel("Supermarket Shoebox")
roomsolid = HBRoomFromSolid(geo=flatten(geo), name=panel_9, constr_set=constructionset, program=programtype, conditioned=True)  # -> report, rooms; plug-in component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

weather_file = ClusterInput()

# ----
# Weather File (2000 - 2020)
toggle = BooleanToggle(True)
simoutput = HBSimulationOutput(zone_energy_use=toggle, gains_and_losses=toggle, surface_energy_flow=toggle)  # -> report, sim_output; plug-in component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
epwtoddy = LBEPWToDDY(weather_file=weather_file, monthly_cool=toggle, write=toggle)  # -> ddy_file; plug-in component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
sizingpar = HBSizingParameter(ddy_file=epwtoddy, filter_ddays=toggle)  # -> sizing; plug-in component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
simpar = HBSimulationParameter(output=simoutput.sim_output, timestep=6, sizing=sizingpar)  # -> sim_par; plug-in component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

epw_file = ClusterInput()
run = ClusterInput()

# ----
# DOAS
number_slider_3 = Slider(2, range=0..10)
thermalzone = IB_ThermalZone(_HBRooms=roomsolid.rooms, IsAirTerminalPriorToZoneEquipments=True, allowMultiAirloops=False, dupNum=False)
objparams_2 = IB_ObjParams(
    CentralHeatingMaximumSystemAirFlowRatio="1",
    TypeofLoadtoSizeOn="VentilationRequirement",
    DataFieldSetType="Ironbug.HVAC.IB_SizingSystem_FieldSet")
objparams_3 = IB_ObjParams(RatedCOP=number_slider_3, DataFieldSetType="Ironbug.HVAC.IB_CoilCoolingDXSingleSpeed_FieldSet")
oasystem = Ironbug_OutdoorAirSystem()
coilclndx1 = Ironbug_CoilCoolingDXSingleSpeed(Parameters_=objparams_3, dupNum=False)
coilhtngas = Ironbug_CoilHeatingGas(dupNum=False)
spm_scheduled_2 = Ironbug_SetpointManagerScheduled(Temperature="21.11", dupNum=False)
airloopbranches = AirLoopBranches(Branch1=thermalzone)
objparams_4 = IB_ObjParams(Name="DOAS", DataFieldSetType="Ironbug.HVAC.IB_AirLoopHVAC_FieldSet")
sizingsystem = Ironbug_SizingSystem(Parameters_=objparams_2, dupNum=False)

# ----
# District Cooling System
objparams_5 = IB_ObjParams(DataFieldSetType="Ironbug.HVAC.IB_FanVariableVolume_FieldSet")

fanvariable = Ironbug_FanVariableVolume(Parameters_=objparams_5, dupNum=False)
merge = Merge(Data1=oasystem, Data2=coilclndx1, Data3=coilhtngas, Data4=fanvariable, Data5=spm_scheduled_2)
airloop = Ironbug_AirLoopHVAC(Supply=merge, Demand=airloopbranches, SizingSystem=sizingsystem, Parameters_=objparams_4, dupNum=False)

hvacsystem = IB_HVACSystem(AirLoops=flatten(airloop), PlantLoops=flatten(cwloop))
detailedhvac = HBDetailedHVAC(hb_objs=flatten(roomsolid.rooms), hvac_system=hvacsystem)  # -> report, hb_objs; plug-in component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

toggle_2 = BooleanToggle(True)
solveadj = HBSolveAdjacency(rooms=flatten(detailedhvac.hb_objs), air_boundary=toggle_2, overwrite=toggle_2, run=toggle_2)  # -> report, adj_rooms; plug-in component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

# ----
# WWR
number_slider_4 = Slider(0.4, range=0..1)
aperturesbyratio = HBAperturesByRatio(hb_objs=flatten(solveadj.adj_rooms), ratio=number_slider_4, subdivide=Toggle(False))  # -> report, hb_objs; plug-in component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

model = HBModel(rooms=flatten(aperturesbyratio.hb_objs), name="Supermarket Archetype")  # -> report, model; plug-in component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

# ----
# Run Simulation
toggle_3 = BooleanToggle(True)
modeltoosm = HBModelToOSM(model=model.model, epw_file=epw_file, sim_par=simpar, write=toggle_3, run=run)  # -> report, jsons, osw, osm, idf, sql, zsz, rdd, html; plug-in component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
eui = HBEndUseIntensity(sql=modeltoosm.sql, ip=Toggle(False))  # -> eui, eui_end_use, end_uses, gross_floor; plug-in component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

idf = ClusterOutput(modeltoosm.idf)
eui_2 = ClusterOutput(eui.eui)
eui_end_use = ClusterOutput(eui.eui_end_use)
end_uses = ClusterOutput(eui.end_uses)
gross_floor = ClusterOutput(eui.gross_floor)
